vi "LTE Host UE.gvi"   [LabVIEW Communications System Design Suite 2.0.1]
# Enqueue an element into the stop notifier if error in indicates an error. Call after each loop on host top level to synchronize host shut down in case of any error.
panel controls:
  "RIO Device": string = "RIO0"  # The RIO address of the RF hardware device
  "UE Transmitter": bool  # Enables or disables the transmitter using the current configuration.
  "UE RX Frequency [Hz]": f64 = 2000000000  # DL RX center frequency, allowed range depends on used RF device.
  "UE Manual Gain [dB]": f64  # Controls the analog RX gain in case UE AGC is switched off.
  "Transmit IP Address": string = "127.0.0.1"  # The IP address the UDP packets received from PDSCH shall be sent to.
  "UDP Transmit Port": u16 = 60000  # The UDP port the UDP packets received from PDSCH shall be sent to.
  "UE AGC": bool = TRUE  # Enables or disables the automated gain control on the receiver side. If enabled the analog RX gain of the RF device will be automatically configured within its valid range to meet a target range for the baseband receive power.
  "stop": bool
  "Reference Clock Source": string = "Internal"  # Configures the Reference Clock source used for the transceiver chain. Internal: Device internal clock REF IN / ClkIn: Clock input at the RF device (i.e. rear connector pane at USRP RIO, front connector pane for NI 579x) PXI_CLK: Backplane clock from the PXI Chassis (NI 579x only) GPS: GPS module (NI USRP RIO 295x only)
  "UE Receiver": bool  # Enables or disables the receiver using the current configuration.
  "UE RX RF Port (USRP)": enum{"RX2/RF0", "RX2/RF1"} = "RX2/RF1"  # Selects the HW RF port the DL RX will be received from (USRP RIO only).
  "symbol number for PDSCH constellation": u8 = 4  # The OFDM symbol number (counting from 0 with symbol 0 being occupied by the PDCCH) used for displaying constellation data for PDSCH IQ samples.
  "throughput select": T2 = "PDSCH (CRC ok)"  # Selects the used values for throughput calculation: PDSCH (overall): the total throughput scheduled by the eNodeB TX regardless of CRC result. PDSCH (CRC ok): the really achieved physical layer throughput, which could be decoded successfully. User data (to UDP): the higher layer throughput (from/to UDP stream) after removing the padding.
  "UE TX Frequency [Hz]": f64 = 1800000000  # UL TX center frequency, allowed range depends on used RF device.
  "UE Max RF TX Power [dBm]": f64 = 10  # Maximum RF transmit output power (upper bound - achievable for a full scale complex sine wave (CW) signal) Note: The actual time-domain RF transmit power depends on the configured resource allocation and is typically at least 15dB lower to allow for the OFDM PAPR backoff.
  "UE TX RF Port (USRP)": enum{"TX1/RF0", "TX1/RF1"} = "TX1/RF0"  # Selects the HW RF port the UL TX will be transmitted on (USRP RIO only).
  "UE TX UE Context": cluster{"RNTI": u16, "SRS Configuration": T3} = {1, TRUE, "0x200", TRUE}
    # UE-specific parameters for UL transmission.
    # RNTI: The radio network temporary identifier used for PUSCH scrambling.
    # SRS Configuration: The configuration used for transmitting sounding reference signal.
    # SRS Enabled: If TRUE, SRS location is reserved as last symbol in each UL subframe (FDD, TDD) and last 2 symbols in each special subframe (TDD) (according to 3GPP TS 36.211 §5.5.3.3: FDD: srs-SubframeConfig = 0, TDD: srs-SubframeConfig = 7).
    # SRS Subframe Allocation: Bitmap determining the subframes actually used for SRS transmission. Periodicity of 10, leftmost bit represents subframe 0.
    # Transmission Comb: Parameter transmissionComb k_TC determining if even (0) or odd (1) subcarriers are used for SRS transmission/reception. See also 3GPP TS 36.211 §5.5.3.2.
  "Timing Advance [samples]": u32  # The applied UL timing advance, i.e. the number of samples the UL TX is started earlier than the DL RX. Given in 30.72 MS/s domain.
  "UE TX Frame Structure": enum{"FDD", "TDD 5 5"} = "FDD"  # Select between FDD (frequency division duplex) and TDD (time division duplex) using subframe configuration 5 and special subframe configuration 5 (3GPP TS 36.211 §4).
  "UE RX Frame Structure": enum{"FDD", "TDD 5 5"} = "FDD"  # Select between FDD (frequency division duplex) and TDD (time division duplex) using subframe configuration 5 and special subframe configuration 5 (3GPP TS 36.211 §4).
  "UE TX Cell ID": u16  # Physical cell ID used for PUSCH scrambling.
  "UE RX Cell ID": u16  # Physical cell ID used for PSS, CRS, UERS sequence generation and PDCCH/PDSCH scrambling. [0…511].
  "UE TX DCI": T6 = {"Active"=TRUE, "MCS"="MCS 9 (QPSK, rate ~0.66)", "Resource Block Allocation (4 PRB/bit)"=33554431}  # Parameters for transmission of PUSCH. MCS: Modulation and coding scheme used for PUSCH transmission according to 3GPP TS 36.213 §7.1.7. Active: Enables or disabled the transmission of the PUSCH. Resource Block Allocation: Resource allocation for PUSCH given as bitmap with each bit representing 4 physical resource blocks (DL resource allocation type 0, 3GPP TS 36.312 §7.1.6.1). Leftmost bit represents lowest resource block index.
  "session": "LTE Host Session.gtype"
  "UE RX UE Context": T12 = {"RNTI"=1, "Use UERS"=FALSE, "Antenna Port"=7, "CCE Offset"=0}
    # UE specific parameters for DL reception.
    # Use UERS: If enabled the DL receiver will use UE specific reference signals for equalizing PDSCH assigned I/Q samples. The usage of UERS is closely related to Transmission Mode 9 defined in the LTE standard 3GPP TS 36.213 §7.1.
    # RNTI: The radio network temporary identifier used for PDSCH scrambling and PDCCH CRC mask check.
    # Antenna Port: The antenna port used for generating UERS for channel estimation, Range: 7…14 according to 3GPP TS 36.213 §7.1.
    # CCE Offset: First control channel element to be used for PDCCH reception. According to 3GPP TS 36.211 §6.8.1/.2.
  "Command": string = "ns3.26-ni-lte-simple-optimized"  # Command to execute for external MAC.
  "External MAC": bool = TRUE  # When enabled a program is executed on the RT described by command line and arguments. This switch applies for RT only. When disabled an internal basic MAX will be executed.
  "Arguments": string = "--numPackets=100 --simTime=120 --niApiDevMode=\"NIAPI_TS\" --niApiEnableLogging=\"true\" --niApiLteEnabled=\"true\""  # Arguments to pass to the external MAC.
  "Tab": i32
  "Stop on API Confirmation Errors": bool
  "Start Extern": bool  # When enabled a program is executed on the RT described by command line and arguments. This switch applies for RT only. When disabled an internal basic MAC will be executed.
panel indicators:
  "FPGA Ready": bool  # Signals that the FPGA bitfile has been downloaded and that the device has been initialized and is ready for configuration. (Initialization can take up to 20 seconds).
  "UE RX Active": bool  # Signals that all UE RX control configurations have been applied and the receiver is running.
  "UE Coerced Gain [dB]": f64  # The actual used analog RX RF gain either set by AGC, if enabled, or by UE Manual Gain Value [dB].
  "UE ADC Values Clipped": bool  # Indicates a numeric overflow at the ADC output (i.e. analog RX RF gain too high or receive power level too high).
  "UE Baseband RX Power [dBFS]": f64  # The measured baseband receive power level in dB full scale.
  "UE RX Power Spectrum": T1  # Shows the power spectrum of the DL RX baseband signal received from RF. If synchronization is successful frequency offset compensation is applied.
  "PDSCH Constellation": c128[]  # Constellation of RX IQ samples allocated for PDSCH transmission after equalization. Only samples for the configured OFDM Symbol-Nr (PDSCH) are displayed.
  "PDCCH Constellation": c128[]  # Constellation of RX IQ samples allocated for PDCCH transmission after equalization.
  "DL throughput": f64[][]
  "UE Failure / Block Error Rate (BLER)": f64[][]  # Numerical and graphical display of error rates for synchronization detection, PDCCH and PDSCH decoding.
  "UE Frequency Offset [Hz]": f64  # The estimated and compensated frequency offset detected in the RX signal.
  "Sync Found": bool  # Indicates that the synchronization module has successfully detected and synchronized to a DL RX signal.
  "UE DDC Values Clipped": bool  # Indicates a numeric overflow at the output of the digital downconversion block (i.e. analog RX RF gain too high or input power level too high).
  "Packet Loss Out": bool  # Indicates that the system loses UDP data due to overload (i.e. data inflow from PDSCH is higher than UDP throughput).
  "channel estimation": f64[][]  # Graphical representation of the normalized channel amplitude and phase estimated on the cell specific reference signals.
  "Data Transfer Out": bool  # Indicates that the configured UDP stream is sending data to the configured Transmit IP Address using Transmit Port.
  "DL throughput (current)": f64  # Numerical and graphical indication of scheduled, successfully decodable and actually used channel capacity. PDSCH (overall): the total throughput scheduled by the eNodeB TX regardless of CRC result. PDSCH (CRC ok): the really achieved physical layer throughput, which could be decoded successfully. User data (to UDP): the higher layer throughput (from/to UDP stream) after removing the padding
  "UE Coerced Max RF TX Power [dBm]": f64  # Indicates the coerced value actually used as maximum RF transmit output power after applying the device’s capabilities (range and resolution limitations) to the configured UE Maximum RF TX Power [dBm].
  "UE TX Power Spectrum": T1  # Shows the power spectrum of the UL TX baseband signal transferred to the RF.
  "UE TX Active": bool  # Signals that all UE TX control configurations have been applied and the transmitter is running.
  "Subband SINR [dB]": f64[]  # The estimated SINR for each subband occupying 8 PRBs. Comparable to Reporting Mode 3-0 in 3GPP TS 36.213 §7.2.1. Usage of CRS or UERS for estimation depends on setting of Use UERS switch in UE RX System Parameters.
  "TX starting": bool
  "UE TX IFFT Output Clipped": bool  # Indicates a numeric overflow after the IFFT.
  "Wideband SINR [dB]": f64  # The estimated SINR over the full 20MHz band using cell specific reference signals.
  "BLER cluster": cluster{"PDSCH": f64, "PDCCH": f64, "sync": f64}
  "UE RF RX Power [dBm]": f64  # The measured time domain receive power at the RX RF port.
  "power calibration offset [dB]": f64
  "PDCCH Received DCI Message": T5[]  # Array of decoded and interpreted downlink control information messages received on PDCCH and applied to PDSCH decoding. Each element corresponds to a DL subframe.
  "Radio Frame Number": u16
  "UE RF TX Power [dBm]": f64  # Actual UE RF transmit power in dBm.
  "UE Baseband TX Power [dBFS]": f64  # Actual UE baseband transmit power level [baseband output power level] in dB full scale.
  "UE Applied Gain [dB]": f64
  "PHY Timing Indication Received": u32
  "TTI": u8
  "SFN": u16
  "L1-L2 Interface active": bool
  "MAC TX Total Delay": u32
  "DL RX Indication CRC OK": bool
  "Error Report": string
  "device bandwidth [MHz]": u16
  "External MAC Output": string
  "Received Confirmations": T13
  "Negatives": u64
  "Evaluation Errors": u32
  "MPDU Disassembly Failed": bool  # specific error cleared? indicates whether the error referenced by specific error code to clear has been cleared.
  "Status": string
types:
  T1 = cluster{"f0": f64, "df": f64, "magnitude": f64[]}
  T2 = enum{"PDSCH (overall)", "PDSCH (CRC ok)", "User data (to UDP)"}
  T3 = cluster{"SRS Enabled": bool, "SRS Subframe Allocation": UFXP(10.0), "Transmission Comb": bool}
  T4 = enum{"MCS 0 (QPSK, rate ~0.12)", "MCS 1 (QPSK, rate ~0.15)", "MCS 2 (QPSK, rate ~0.19)", "MCS 3 (QPSK, rate ~0.25)", "MCS 4 (QPSK, rate ~0.30)", "MCS 5 (QPSK, rate ~0.37)", "MCS 6 (QPSK, rate ~0.44)", "MCS 7 (QPSK, rate ~0.51)", "MCS 8 (QPSK, rate ~0.59)", "MCS 9 (QPSK, rate ~0.66)", "MCS 10 (16-QAM, rate ~0.33)", "MCS 11 (16-QAM, rate ~0.37)", "MCS 12 (16-QAM, rate ~0.42)", "MCS 13 (16-QAM, rate ~0.48)", "MCS 14 (16-QAM, rate ~0.54)", "MCS 15 (16-QAM, rate ~0.60)", "MCS 16 (16-QAM, rate ~0.64)", "MCS 17 (64-QAM, rate ~0.43)", "MCS 18 (64-QAM, rate ~0.46)", "MCS 19 (64-QAM, rate ~0.50)", "MCS 20 (64-QAM, rate ~0.55)", "MCS 21 (64-QAM, rate ~0.60)", "MCS 22 (64-QAM, rate ~0.65)", "MCS 23 (64-QAM, rate ~0.70)", "MCS 24 (64-QAM, rate ~0.75)", "MCS 25 (64-QAM, rate ~0.80)", "MCS 26 (64-QAM, rate ~0.85)", "MCS 27 (64-QAM, rate ~0.89)", "MCS 28 (64-QAM, rate ~0.93)"}
  T5 = cluster{"Valid": bool, "MCS": T4, "Resource Block Allocation (4 PRB/bit)": UFXP(25.0)}
  T6 = cluster{"Active": bool, "MCS": T4, "Resource Block Allocation (4 PRB/bit)": UFXP(25.0)}
  "LTE Transport Session.gtype" = cluster{"FIFO pathname": string, "pipe reader": "Pipe Reader.gtype", "pipe writer": "Pipe Writer.gtype", "transport in RT FIFO": RTFifoRefnum<u8[]>, "transport out RT FIFO": RTFifoRefnum<u8[]>, "transport in timing source name": string, "transport in timing trigger ID": u8, "transport out timing source name": string, "transport out timing trigger ID": u8, "maximum API message size": u32}
  "niInstr Register Bus v0 Host.lvlib__Register Bus Session.gtype" = Queue<"niInstr Register Bus v0 Host.lvlib__Session Data.gtype">
  "Semaphore RefNum.gtype" = i32
  "niUsrpRio Config v1 Host.lvlib__DB Queue Reference.gtype" = Queue<"niUsrpRio Config v1 Host.lvlib__Daughterboard Data.gtype">
  "niUsrpRio Config v1 Host.lvlib__niUsrpRio Session.gtype" = cluster{"FPGA Interface": any, "RIO Interface Number": u32, "Data Clock Rate": u32, "FPGA Data Clock Rate": u32, "Global Settings Register Bus": "niInstr Register Bus v0 Host.lvlib__Register Bus Session.gtype", "Radio 0 Settings Register Bus": "niInstr Register Bus v0 Host.lvlib__Register Bus Session.gtype", "Radio 1 Settings Register Bus": "niInstr Register Bus v0 Host.lvlib__Register Bus Session.gtype", "Radio Settings Bus Semaphore": "Semaphore RefNum.gtype", "DB Queues": "niUsrpRio Config v1 Host.lvlib__DB Queue Reference.gtype"[], "Characterization Data Valid?": bool, "EEPROM Header": "niUsrpRio Config v1 Host.lvlib__EEPROM Header.gtype", "Device Data Header": "niUsrpRio Config v1 Host.lvlib__EEPROM Device Data Header.gtype", "EEPROM Characterization Header": "niUsrpRio Config v1 Host.lvlib__EEPROM Characterization Header.gtype", "Characterization Data": "niUsrpRio Config v1 Host.lvlib__Characterization Data.gtype"[], "FPGA Current Version": u32, "FPGA Oldest Compatible Version": u32, "Fixed Logic Current Version": u32, "Fixed Logic Oldest Compatible Version": u32, "FPGA Radio Settings Bus Current Version": u32, "FPGA Radio Settings Bus Oldest Compatible Version": u32, "FPGA Board Config Current Version": u32, "FPGA Board Config Oldest Compatible Version": u32, "Daughterboard Clock Rate": u32}
  T7 = cluster{"FPGA ref": any, "bus instance": u32, "instruction FIFO depth": u32, "executing on FPGA target": bool, "show error call chain": bool}
  T8 = cluster{"Actual Gain [dB]": f64, "Attenuation Table Index": i32}
  T9 = cluster{"Attenuation Table [dB]": f64[][], "Frequencies [Hz]": f64[], "IQ Imbalance Table": "niUsrpRio Config v1 Host.lvlib__IQ Imbalance.gtype"[], "Gain Table": T8[][]}
  T10 = cluster{"FlexRIO Register Bus": Queue<T7>, "RX Characterization Data": T9, "TX Characterization Data": T9, "FPGA Interface": any}
  T11 = cluster{"transport block size": u32, "CRC ok": bool, "user data": u32}
  "LTE Host Session.gtype" = cluster{"target": enum{"USRP", "FlexRIO"}, "real time mode": bool, "MAC Stub enabled": bool, "DMA FIFO read timeout": i32, "timed loop period": i64, "LTE Transport Sessions": "LTE Transport Session.gtype"[], "USRP session": "niUsrpRio Config v1 Host.lvlib__niUsrpRio Session.gtype", "FlexRIO session": T10, "UDP RX session": UdpNetworkConnectionRefnum, "UDP TX session": UdpNetworkConnectionRefnum, "sync found queue": Queue<bool>, "PDCCH CRC ok queue": Queue<bool>, "DL PDCCH status queue": Queue<cluster{"CRC ok": bool, "subframe number": u32}>, "DL PDSCH status queue": Queue<cluster{"CRC ok": bool, "subframe number": u32}>, "DL SINR queue": Queue<f64[]>, "PDSCH user data queue": Queue<u32>, "PDSCH user data UDP queue": Queue<T11>, "PDSCH user data throughput queue": Queue<T11>, "PUSCH user data queue": Queue<u32>, "PUSCH user data UDP queue": Queue<T11>, "PUSCH user data throughput queue": Queue<T11>, "UE feedback info FIFO": RTFifoRefnum<u8[]>, "Request information FIFO": RTFifoRefnum<"LTE Request Information.gtype">, "UDP TX outbound FIFO": RTFifoRefnum<u8[]>, "UDP RX inbound FIFO": RTFifoRefnum<u8[]>, "stop notifier": Notifier<string>, "DL RX scope": string, "UL RX scope": string, "external MAC log file": string, "external MAC process ID": u32}
  T12 = cluster{"RNTI": u16, "Use UERS": bool, "Antenna Port": UFXP(4.0), "CCE Offset": u8}
  "LTE Confirmation States.gtype" = enum{"Success", "Unknown Message", "Message not Supported", "Unknown Parameter (Set)", "Missing Parameter (Set)", "Parameter (Set) Repetition", "Range Violation", "State Violation", "Timeout", "Config Payload Mismatch", "Length Mismatch", "Input Buffer Full", "Internal Error", "Instance ID Mismatch"}
  T13 = cluster{"Element 1": "LTE Confirmation States.gtype"[], "Value": u64[]}
  "DTP Send Status.gtype" = cluster{"send packet counter": u32, "network too slow counter": u32}
  "DTP Pending Data.gtype" = cluster{"expected size": u32, "payload": u8[]}
diagram:
  sequence {
    frame 0 {
      # Set Controls to default values
      $"L1-L2 Interface active" <- FALSE
      $"UE Transmitter" <- FALSE
      $"UE Receiver" <- FALSE
      $"FPGA Ready" <- FALSE
      $"UE RX Active" <- FALSE
      $"UE TX Active" <- FALSE
      $"TX starting" <- FALSE
      $"Sync Found" <- FALSE
      $"PDSCH Constellation" <- c128[] []
      $"PDCCH Constellation" <- c128[] []
      Build Array(f64[] [], f64[] [], f64[] []) -> w1
      $"DL throughput" <- w1
      $"UE Failure / Block Error Rate (BLER)" <- w1
      $"channel estimation" <- w1
      $"UE RX Power Spectrum" <- T1 {all zero or empty}
      $"UE TX Power Spectrum" <- T1 {all zero or empty}
      $"UE Coerced Max RF TX Power [dBm]" <- 0
      $"UE Coerced Gain [dB]" <- 0
      $"Wideband SINR [dB]" <- 0
      $"DL throughput (current)" <- 0
      $"Subband SINR [dB]" <- f64[] []
      $"PDCCH Received DCI Message" <- T5[] []
      $"Error Report" <- ""
      $Status <- ""
    }
  }
  call "RT Startup Create Notifier.gvi"(Error In=no error) -> (Error Out=w2)
  # NI API CHANGE
  s1 = w2  # shift register
  while {
    Wait Until Next Multiple(multiple to wait=100)
    call "RT Startup Receive Notivication.gvi"(error in=s1) -> (error out=w3, notification=w4)
    $Status <- w4
    Is Equal(x=w4, y="System Init Complete!") -> w5
    next s1 = w3
    stop if w5
  }
  call "LTE UE Host Initialization.gvi"(USRP device=$"RIO Device", session in=$session, error in=w2, reference clock source=$"Reference Clock Source", start externally=$"Start Extern", external MAC=$"External MAC", command=$Command, arguments=$Arguments) -> (error out=w6, session out=w7, device bandwidth=w8)
  sequence {
    frame 0 {
      $session <- w7
      call "Display Error.gvi"(type of dialog="continue or stop message", error in=w6)
      $"L1-L2 Interface active" <- TRUE
    }
  }
  disable {
    frame TARGET_TYPE == "RT", Default {
      # Transport layer moves packets from L1 to MAC Stub implementation or external MAC
      call "LTE Transport.gvi"(session=w7, error in=w6) -> (error out=w10)
      # NI API CHANGE
      call "LTE Get Transport Session.gvi"(Session=w7, Transport Session Select="Transport PHY Timing to MAC") -> (LTE Transport Session=w11, Session dup=w12)
      Property Node(instance in=w11) -> ("transport out timing source name"=w13)
      w14 = 100  # priority in
      timed loop {
        # MAC Stub: handle TX messages
        Left Execution System Border Node(priority_in=w14, processor_in=1)
        Left Timing Source Border Node[AlarmName=L, DefaultTimingSourceName="1 MHz", DefaultTimingSourceType=2](mode_in="Process missed periods, ignore original phase", period_in=1, source_in=w13, structure_in="MAC Stub Tx")
        call "LTE Get Transport Session.gvi"(Session=w12, Transport Session Select="Transport PHY Timing to MAC") -> (LTE Transport Session=w15, Session dup=w16)
        Left Timing Error Border Node(error_in=w6) -> (error_out=w17)
        call "LTE Transport Read From Transport.gvi"(API transport session=w15, error in=w17, allow read fail=$"L1-L2 Interface active") -> (transport out=w18, transport read success=w19, error out=w20)
        case (w19) {
          frame False {
            w21 = w20
          }
          frame True {
            call "LTE PHY Receive Timing Indication.gvi"(api transport in=w18, error in=w20) -> (SFN=w22, TTI index=w23, error out=w24)
            call "LTE Check Subframe for Transmit.gvi"(frame structure=$"UE TX Frame Structure", subframe index=w23, UL TX=TRUE, error in=w24) -> (allow UL transmit=w25, error out=w26)
            case (w25) {
              frame False, Default {
                w21 = w26
              }
              frame True {
                call "LTE MAC Prepare UL Tx Config.gvi"(SFN=w22, TTI index=w23) -> (MAC TX Config=w27)
                call "LTE Receive Feedback Information.gvi"(session=w16, error in=w26) -> (feedback info=w28, error out=w29)
                Array Size(array=w28) -> (size(s)=w30)
                Is Greater Than 0(x=w30) -> w31
                case (w31) {
                  frame False, Default {
                    w21 = w29
                  }
                  frame True {
                    To Unsigned Long Integer(number=w30) -> w32
                    call "LTE PHY TX Request Confirm Abstraction.gvi"(MAC TX Config=w27, MAC PDU Size=w32, MAC PDU=w28, Device Location="UE", error in=w29) -> (api transport out=w33, error out=w34, requests=w35)
                    Property Node(instance in=w16) -> ("Request information FIFO"=w36, instance out=w37)
                    call "LTE MAC Enque Requests.gvi"(RT FIFO reference=w36, requests=w35, error in=w34) -> (error out=w38)
                    call "LTE Get Transport Session.gvi"(Session=w37, Transport Session Select="Transport MAC to PHY") -> (LTE Transport Session=w39)
                    call "LTE Transport Send To Transport.gvi"(API transport session=w39, transport in=w33, error in=w38) -> (error out=w21)
                  }
                }
              }
            }
          }
        }
        Right Timing Error Border Node(error_in=w21) -> (error_out=w40)
        Left Timing Statistics Border Node() -> (wakeupreason_out=w41)
        continue if $"L1-L2 Interface active"
      }
      call "LTE Remove Timed Loop Abort Error.gvi"(error in=w40, wake up reason=w41) -> (error out=w42)
      call "Stop On Error.gvi"(error in=w42, error source prefix="MAC Stub Tx") -> (error out=w43)
      call "LTE Get Transport Session.gvi"(Session=w7, Transport Session Select="Transport PHY to MAC") -> (LTE Transport Session=w44, Session dup=w45)
      Property Node(instance in=w44) -> ("transport out timing source name"=w46)
      # NI API CHANGE
      w47 = 98  # priority in
      timed loop {
        # MAC Stub: handle RX messages
        Left Execution System Border Node(priority_in=w47, processor_in=2)
        Left Timing Source Border Node[AlarmName=L, DefaultTimingSourceName="1 MHz", DefaultTimingSourceType=2](mode_in="Process missed periods, ignore original phase", period_in=1, source_in=w46, structure_in="MAC Stub Rx")
        call "LTE Get Transport Session.gvi"(Session=w45, Transport Session Select="Transport PHY to MAC") -> (LTE Transport Session=w48, Session dup=w49)
        Left Timing Error Border Node(error_in=w6) -> (error_out=w50)
        call "LTE Transport Read From Transport.gvi"(API transport session=w48, error in=w50, allow read fail=$"L1-L2 Interface active") -> (transport out=w51, transport read success=w52, error out=w53)
        case (w52) {
          frame False {
            w54 = w53
          }
          frame True {
            call "LTE Decode General Message Header.gvi"(message data in=w51, error in=w53) -> (decoded general message header=w55, error out=w56)
            Property Node(instance in=w55) -> ("message type ID"=w57)
            case (w57) {
              frame 0, Default {
                call "Build Error Cluster.gvi"(code=-1, description="MAC Stub Rx: unexpected API message", error in=w56) -> (error out=w54)
              }
              frame 16898 {
                # PHY_CNF
                Property Node(instance in=w49) -> ("Request information FIFO"=w58)
                Not(x=$"Stop on API Confirmation Errors") -> w59
                call "LTE Handle DL TX Confirm.gvi"(RT FIFO reference=w58, api transport in=w51, error in=w56, clear confirmation errors=w59) -> (error out=w54, confirm received counts=w60, confirmation evaluation error count=w61, negative confirm received count=w62)
                $"Received Confirmations" <- w60
                $Negatives <- w62
                $"Evaluation Errors" <- w61
              }
              frame 18433 {
                call "LTE PHY Receive RX Indication.gvi"(api transport in=w51, expected device location="UE", error in=w56) -> (MAC RX Config=w63, MAC PDU=w64, error out=w65)
                # PHY_DLSCH_RX_IND
                Property Node(instance in=w63) -> ("CRC Result"=w66)
                Is Greater Than 0(x=w66) -> w67
                case (w67) {
                  frame False, Default {
                    w54 = w65
                  }
                  frame True {
                    Property Node(instance in=w49) -> ("UDP RX inbound FIFO"=w68, instance out=w69)
                    call "LTE MAC PDU Disassembly.gvi"(MAC PDU=w64, error in=w65, FIFO in=w68) -> (bytes=w70, error out=w71)
                    call "Filter Error Code.gvi"(code to clear=-1, error in=w71) -> (error cleared?=w72, error out=w73)
                    case (w72) {
                      frame True {
                        w54 = w73
                      }
                      frame False {
                        Property Node(instance in=w69) -> ("PDSCH user data queue"=w74)
                        To Unsigned Long Integer(number=w70) -> w75
                        Scale By Power Of 2(n=3, x=w75) -> w76
                        Enqueue Element(element=w76, error in=w73, queue=w74, timeout in ms=0) -> (error out=w54)
                      }
                    }
                    $"MPDU Disassembly Failed" <- w72
                  }
                }
                $"DL RX Indication CRC OK" <- w67
              }
            }
          }
        }
        Right Timing Error Border Node(error_in=w54) -> (error_out=w77)
        Left Timing Statistics Border Node() -> (wakeupreason_out=w78)
        continue if $"L1-L2 Interface active"
      }
      call "LTE Remove Timed Loop Abort Error.gvi"(error in=w77, wake up reason=w78) -> (error out=w79)
      call "Stop On Error.gvi"(error in=w79, error source prefix="MAC Stub Rx") -> (error out=w80)
      w81 = 100  # priority in
      # NI API CHANGE
      Property Node(instance in=w7) -> ("timed loop period"=w82)
      timed loop {
        Left Execution System Border Node(priority_in=w81, processor_in=1)
        # handle TTI timing indication every 1ms
        Left Timing Statistics Border Node()
        Left Timing Error Border Node(error_in=w6) -> (error_out=w83)
        call "LTE Receive Timing Indication RT.gvi"(session=w7, error in=w83, eNB TX Active=$"UE TX Active") -> (error out=w84, subframe index=w85, subframe index valid=w86)
        case (w86) {
          frame False {
            w87 = w84
            w88 = w86
            w89 = w7
          }
          frame True, Default {
            call "Get Time.gvi"(error in_2=w84) -> (tick count (us)=w90, error out_2=w91)
            call "LTE TTI Counter to SFN and TTI.gvi"(TTI counter=w85, error in=w91) -> (SFN=w92, TTI=w93, error out=w94)
            call "Counter U16 Dominant Increment.gvi"() -> (count out=w95)
            call "LTE Encode PHY SAP Timing Indication.gvi"(reference ID=w95, SFN=w92, TTI index=w93, error in=w94) -> (encoded PHY SAP Timing Indication=w96, error out=w97)
            call "LTE Get Transport Session.gvi"(Session=w7, Transport Session Select="Transport PHY Timing to MAC") -> (LTE Transport Session=w98, Session dup=w89)
            call "LTE Transport Send To Transport.gvi"(API transport session=w98, transport in=w96, error in=w97) -> (error out=w87)
            $SFN <- w92
            $TTI <- w93
            $"PHY Timing Indication Received" <- w90
            w88 = w86
          }
        }
        Logical And(w88, $"UE RX Active") -> w99
        case (w99) {
          frame False, Default {
            w100 = w87
          }
          frame True {
            call "LTE Send Dynamic DL RX Configuration.gvi"(session=w89, UE context=$"UE RX UE Context", error in=w87) -> (error out=w100)
          }
        }
        Right Timing Error Border Node(error_in=w100) -> (error_out=w101)
        Left Timing Source Border Node[AlarmName=L, DefaultTimingSourceName="1 MHz", DefaultTimingSourceType=2](mode_in="Discard missed periods, ignore original phase", period_in=w82, structure_in="PHY SAP Tim")
        continue if $"L1-L2 Interface active"
      }
      call "Stop On Error.gvi"(error in=w101, error source prefix="PHY SAP Tim") -> (error out=w102)
      call "LTE Get Transport Session.gvi"(Session=w7, Transport Session Select="Transport MAC to PHY") -> (LTE Transport Session=w103, Session dup=w104)
      Property Node(instance in=w103) -> ("transport out timing source name"=w105)
      w106 = 99  # priority in
      # NI API CHANGE
      timed loop {
        # handover Tx Req to FPGA
        Left Execution System Border Node(priority_in=w106, processor_in=1)
        Left Timing Statistics Border Node()
        call "LTE Get Transport Session.gvi"(Session=w104, Transport Session Select="Transport MAC to PHY") -> (LTE Transport Session=w107, Session dup=w108)
        Left Timing Error Border Node(error_in=w6) -> (error_out=w109)
        call "LTE Transport Read From Transport.gvi"(API transport session=w107, error in=w109, allow read fail=$"L1-L2 Interface active") -> (transport out=w110, transport read success=w111, error out=w112)
        call "Get Time.gvi"(error in=w112) -> (error out=w113, tick count (us)=w114)
        Subtract(x=w114, y=$"PHY Timing Indication Received") -> w115
        # reserve time buffer to transmit TX data to FPGA
        w116 = 700  # maximal allowed TX processing time [us]
        Is Greater(x=w115, y=w116) -> w117
        case (w111) {
          frame True {
            call "LTE PHY TX Request Confirm Handler.gvi"(api transport in=w110, Expected SFN=$SFN, Expected TTI index=$TTI, Expected Device Location="UE", error in=w113, frame structure=$"UE TX Frame Structure", use UERS=FALSE, UE TX DCI=$"UE TX DCI", TX request too late=w117) -> (TX Data=w120, error out=w121, api transport out=w122, output valid=w123)
            Logical And(w123, $"UE TX Active") -> w119
            case (w119) {
              frame False, Default {
                w124 = w121
                w125 = w108
              }
              frame True {
                call "LTE Send Dynamic UL Configuration.gvi"(UE context=$"UE TX UE Context", DCI=$"UE TX DCI", scope="TX", session=w108, error in=w121) -> (error out=w126, session dup=w127)
                call "LTE Send Dynamic UL Tx Payload.gvi"(session in=w127, TX data=w120, error in=w126) -> (error out=w124, session out=w125)
              }
            }
            Array Size(array=w122) -> (size(s)=w128)
            Is Greater Than 0(x=w128) -> w129
            case (w129) {
              frame False, Default {
                call "Build Error Cluster.gvi"(code=-1, description="Confirmation message response is empty.", error in=w124) -> (error out=w118)
              }
              frame True {
                call "LTE Get Transport Session.gvi"(Session=w125, Transport Session Select="Transport PHY to MAC") -> (LTE Transport Session=w130)
                call "LTE Transport Send To Transport.gvi"(API transport session=w130, transport in=w122, error in=w124) -> (error out=w118)
              }
            }
          }
          frame False {
            w118 = w113
            w119 = w111
          }
        }
        call "Get Time.gvi"(error in=w118) -> (error out=w131, tick count (us)=w132)
        Right Timing Error Border Node(error_in=w131) -> (error_out=w133)
        case (w119) {
          frame True {
            Subtract(x=w132, y=$"PHY Timing Indication Received") -> w134
            call "Get and Hold Maximum.gvi"(value=w134) -> (max value=w135)
            $"MAC TX Total Delay" <- w135
          }
          frame False { }
        }
        Left Timing Source Border Node[AlarmName=L, DefaultTimingSourceName="1 MHz", DefaultTimingSourceType=2](mode_in="Process missed periods, ignore original phase", period_in=1, source_in=w105, structure_in="PHY SAP Tx")
        continue if $"L1-L2 Interface active"
      }
      call "Stop On Error.gvi"(error in=w133, error source prefix="PHY SAP Tx") -> (error out=w136)
      Property Node(instance in=w7) -> ("timed loop period"=w137)
      # NI API CHANGE
      w138 = 98  # priority in
      timed loop {
        Left Execution System Border Node(priority_in=w138, processor_in=2)
        Left Timing Statistics Border Node()
        Left Timing Error Border Node(error_in=w6) -> (error_out=w139)
        call "LTE Receice PDSCH Decoding Status.gvi"(session=w7, error in=w139) -> (PDSCH Decoding Status valid=w140, PDSCH Decoding Status=w141, error out=w142)
        case (w140) {
          frame False, Default {
            w143 = w142
          }
          frame True {
            Property Node(instance in=w7) -> ("DL PDSCH status queue"=w144, "PDSCH user data throughput queue"=w145, instance out=w146)
            call "LTE PDSCH Channel Decoder Status from U32.gvi"(bit vector in=w141, valid in=TRUE) -> (PDSCH decoder status=w147)
            Property Node(instance in=w147) -> ("user data"=w148, "transport block size"=w149, "CRC ok"=w150)
            Enqueue Element(element=w147, error in=w142, queue=w145, timeout in ms=0) -> (error out=w151)
            Property Node(instance in=w147) -> ("CRC ok"=w152, "user data"=w153)
            w154 = cluster{"CRC ok": bool, "subframe number": u32} {all zero or empty}
            Property Node(instance in=w154, "CRC ok"=w152, "subframe number"=w153) -> (instance out=w155)
            Enqueue Element(element=w155, error in=w151, queue=w144, timeout in ms=0) -> (error out=w156)
            call "LTE Receive PDSCH MAC PDU.gvi"(session=w146, transport block size=w149, error in=w156) -> (MAC PDU=w157, error out=w158)
            call "LTE Get Transport Session.gvi"(Session=w146, Transport Session Select="Transport PHY to MAC") -> (LTE Transport Session=w159)
            Property Node(instance in=$"UE RX UE Context") -> ("RNTI"=w160)
            To Unsigned Byte Integer(number=w148) -> w161
            call "Counter U16 Dominant Increment.gvi"() -> (count out=w162)
            Boolean To Integer(Boolean=w150) -> (0, 1=w163)
            To Unsigned Byte Integer(number=w163) -> w164
            Array Size(array=w157) -> (size(s)=w165)
            To Unsigned Long Integer(number=w165) -> w166
            call "LTE Encode PHY SAP DL RX Indication.gvi"(reference ID=w162, SFN=0, TTI index=w161, MAC PDU=w157, MAC PDU Size=w166, RNTI=w160, CRC Result=w164) -> (encoded UL RX Indication=w167)
            call "LTE Transport Send To Transport.gvi"(API transport session=w159, transport in=w167, error in=w158) -> (error out=w143)
          }
        }
        Right Timing Error Border Node(error_in=w143) -> (error_out=w168)
        Left Timing Source Border Node[AlarmName=L, DefaultTimingSourceName="1 MHz", DefaultTimingSourceType=2](mode_in="Discard missed periods, ignore original phase", period_in=w137, structure_in="PHY SAP Rx")
        continue if $"L1-L2 Interface active"
      }
      call "Stop On Error.gvi"(error in=w168, error source prefix="PHY SAP Rx") -> (error out=w169)
      s2 = w6  # shift register
      while {
        Wait(time to wait=1)
        Property Node(instance in=$session) -> ("UDP RX session"=w170, "UDP RX inbound FIFO"=w171)
        s3 = s2  # shift register
        while {
          RTFIFO Read(error in=s3, rt fifo=w171, timeout in ms=0) -> (element out=w174, empty?=w175, error out=w176)
          Array Size(array=w174) -> (size(s)=w177)
          case (w175) {
            frame True {
              w178 = w176
              w179 = default
            }
            frame False {
              Udp Write Binary(address=$"Transmit IP Address", connection ID=w170, data in=w174, error in=w176, port or service name=$"UDP Transmit Port", timeout ms=0) -> (error out=w180)
              w181 = 55  # UDP timeout
              call "Clear Errors.gvi"(specific error code to clear=w181, error in=w180) -> (specific error cleared?=w179, error out=w178)
            }
          }
          call "Is Error.gvi"(error in=w178) -> (is error?=w182)
          Logical Or(w182, w175) -> w183
          append w179 to w172
          append w177 to w173
          next s3 = w178
          stop if w183
        }
        Add Array Elements(numeric array=w173) -> (sum=w184)
        Scale By Power Of 2(n=3, x=w184) -> w185
        Is Greater Than 0(x=w185) -> w186
        $"Data Transfer Out" <- w186
        Or Array Elements(Boolean array=w172) -> (logical OR=w187)
        $"Packet Loss Out" <- w187
        call "Check Stop.gvi"(error in=s3) -> (error out=w188, stop=w189)
        next s2 = w188
        stop if w189
      }
      call "Stop On Error.gvi"(error in=s2) -> (error out=w190)
      Build Array[ConcatenateInputs=True](w43, w80, w10, w102, w136, w169, w190) -> w9
    }
    frame TARGET_TYPE != "RT" {
      s4 = w6  # shift register
      s5 = "DTP Send Status.gtype" {all zero or empty}  # shift register
      s6 = "DTP Pending Data.gtype" {all zero or empty}  # shift register
      while {
        # receive UDP data from network and send it to the FPGA as PDSCH payload data of the transmitter
        # read received PDSCH payload data from FPGA and send it to the specified UDP port
        Wait Until Next Multiple(multiple to wait=0)
        call "LTE Send UDP Data.gvi"(transmit port=$"UDP Transmit Port", transmit IP address=$"Transmit IP Address", session=$session, enable MAC RX=TRUE, error in=s4, pending data in=s6, UDP send status in=s5) -> (error out=w191, network too slow=w192, transferring data=w193, pending data out=w194, UDP send status out=w195)
        $"Data Transfer Out" <- w193
        # 5
        call "Check Stop.gvi"(error in=w191) -> (error out=w196, stop=w197)
        $"Packet Loss Out" <- w192
        next s4 = w196
        next s5 = w195
        next s6 = w194
        stop if w197
      }
      call "Stop On Error.gvi"(error in=s4) -> (error out=w198)
      s7 = w6  # shift register
      while {
        # send dynamic parameters to FPGA
        case ($"UE TX Active") {
          frame False, Default {
            Wait(time to wait=10)
            w199 = s7
            w200 = TRUE
          }
          frame True {
            call "LTE Receive Timing Indication.gvi"(session=$session, error in=s7) -> (session dup=w201, error out=w202, new timing indication=w200)
            case (w200) {
              frame False, Default {
                w199 = w202
              }
              frame True {
                call "LTE Send Dynamic UL Configuration.gvi"(UE context=$"UE TX UE Context", DCI=$"UE TX DCI", scope="TX", session=w201, error in=w202) -> (error out=w199)
              }
            }
          }
        }
        Logical And(w200, $"UE RX Active") -> w203
        case (w203) {
          frame False, Default {
            w204 = w199
          }
          frame True {
            call "LTE Send Dynamic DL RX Configuration.gvi"(session=$session, UE context=$"UE RX UE Context", error in=w199) -> (error out=w204)
          }
        }
        # 5
        call "Check Stop.gvi"(error in=w204) -> (error out=w205, stop=w206)
        next s7 = w205
        stop if w206
      }
      call "Stop On Error.gvi"(error in=s7) -> (error out=w207)
      Build Array(w198, w207) -> w9
    }
  }
  s8 = w6  # shift register
  while {
    Wait Until Next Multiple(multiple to wait=100)
    Feedback Node[DelayCount=3](input=w208) -> w209
    call "LTE Determine Configuration Trigger.gvi"(RX enabled=$"UE Receiver", TX enabled=$"UE Transmitter") -> (trigger RX configuration=w210, trigger TX configuration=w211)
    # configure UE RX/TX baseband and RF when enabled
    # 1
    case (w210) {
      frame False, Default {
        w212 = s8
      }
      frame True {
        case ($"UE Receiver") {
          frame False, Default {
            call "LTE Disable DL RX.gvi"(session=$session, error in=s8) -> (error out=w212)
            sequence {
              frame 0 {
                $"UE RX Active" <- FALSE
              }
            }
          }
          frame True {
            Property Node(instance in=$session) -> ("real time mode"=w213)
            call "LTE Setup DL RX Baseband.gvi"(frame structure=$"UE RX Frame Structure", session in=$session, error in=s8, cell ID=$"UE RX Cell ID", UE context=$"UE RX UE Context", real time mode=w213) -> (error out=w214, session dup=w215)
            call "LTE Setup RX.gvi"(session in=w215, RX port=$"UE RX RF Port (USRP)", error in=w214, RX frequency [Hz]=$"UE RX Frequency [Hz]", gain value [dB]=$"UE Coerced Gain [dB]", LTE scope="DL") -> (session out=w216, coerced gain [dB]=w217, error out=w218, coerced frequency [Hz]=w219)
            $session <- w216
            $"UE Coerced Gain [dB]" <- w217
            $"UE RX Frequency [Hz]" <- w219
            case (w218) {
              frame Error {
                $"UE Receiver" <- FALSE
                w212 = w218
              }
              frame No Error {
                $"UE RX Active" <- TRUE
                disable {
                  frame TARGET_TYPE == "RT", Default {
                    # For RT, TX triggers RX configuration
                    $"UE Transmitter" <- TRUE
                  }
                  frame TARGET_TYPE != "RT" { }
                }
                w212 = w218
              }
            }
          }
        }
      }
    }
    case (w211) {
      frame False, Default {
        w220 = s8
      }
      frame True {
        case ($"UE Transmitter") {
          frame False, Default {
            sequence {
              frame 0 {
                $"UE TX Active" <- FALSE
              }
              frame 1 {
                Wait(time to wait=10)
              }
            }
            call "LTE Disable UL TX.gvi"(session=$session, error in=s8) -> (error out=w221)
            disable {
              frame TARGET_TYPE == "RT", Default {
                # For RT, disable also RX configuration
                $"UE Receiver" <- FALSE
                w220 = w221
              }
              frame TARGET_TYPE != "RT" {
                w220 = w221
              }
            }
          }
          frame True {
            case (s8) {
              frame Error {
                w222 = s8
              }
              frame No Error {
                $"TX starting" <- TRUE
                w222 = s8
              }
            }
            Property Node(instance in=$session) -> ("real time mode"=w223)
            call "LTE Setup UL TX Baseband.gvi"(UL frequency [Hz]=$"UE TX Frequency [Hz]", session in=$session, frame structure=$"UE TX Frame Structure", cell ID=$"UE TX Cell ID", DCI=$"UE TX DCI", error in=w222, DL frequency [Hz]=$"UE RX Frequency [Hz]", UE Context=$"UE TX UE Context", real time mode=w223) -> (session dup=w224, error out=w225)
            call "LTE Setup TX.gvi"(session in=w224, TX frequency [Hz]=$"UE TX Frequency [Hz]", TX power level [dB]=$"UE Max RF TX Power [dBm]", TX port=$"UE TX RF Port (USRP)", error in=w225, LTE scope="UL", timing advance=$"Timing Advance [samples]") -> (coerced output power [dB]=w226, error out=w227, session dup=w228, coerced frequency [Hz]=w229, coerced power level setting [dB]=w230)
            $"UE Coerced Max RF TX Power [dBm]" <- w226
            case (w227) {
              frame No Error, Default {
                $"UE TX Active" <- TRUE
                $"TX starting" <- FALSE
                call "LTE Setup UL TX Set Active.gvi"(session in=w228, error in=w227) -> (error out=w220)
              }
              frame Error {
                $"UE Transmitter" <- FALSE
                $"TX starting" <- FALSE
                w220 = w227
              }
            }
            $"UE TX Frequency [Hz]" <- w229
            $"UE Max RF TX Power [dBm]" <- w230
          }
        }
      }
    }
    Merge Errors(w212, w220) -> (error out=w231)
    # synchronize the exit condition across all loops of the host application
    call "Create Stop.gvi"(error in=w231, stop in=$stop) -> (error out=w232)
    call "Check Stop.gvi"(error in=w232) -> (error out=w233, stop=w208)
    Not(x=w208) -> w234
    # Disable TX and RX to
    # ensure proper shutdown
    $"L1-L2 Interface active" <- w234
    case (s8) {
      frame Error { }
      frame No Error {
        $"FPGA Ready" <- TRUE
      }
    }
    case (w208) {
      frame False, Default { }
      frame True {
        $"UE Receiver" <- FALSE
        $"UE Transmitter" <- FALSE
      }
    }
    next s8 = w233
    stop if w209
  }
  call "Stop On Error.gvi"(error in=s8) -> (error out=w235)
  s9 = w6  # shift register
  while (iteration -> i1) {
    Wait Until Next Multiple(multiple to wait=50)
    disable {
      frame TARGET_TYPE == "RT", Default {
        w236 = $session
        w237 = s9
      }
      frame TARGET_TYPE != "RT" {
        call "LTE Read PDSCH Decoder Status.gvi"(session in=$session, error in=s9) -> (error out=w237, session dup=w236)
      }
    }
    call "LTE Get ADC and IFFT Status.gvi"(session in=w236, error in=w237) -> (ADC values clipped=w238, error out=w239, TX IFFT output clipped=w240, RX DDC values clipped=w241, session dup=w242)
    call "LTE Read DL BB Power and sync status.gvi"(error in=w239, session in=w242) -> (session dup=w243, error out=w244, RX baseband input power=w245, DL frequency offset [Hz]=w246, signal detected?=w247)
    call "LTE Read TX BB Power.gvi"(error in=w244, session in=w243, TX reference level [dBm]=$"UE Coerced Max RF TX Power [dBm]", LTE scope="UL") -> (session dup=w248, error out=w249, TX power [dBm]=w250, TX baseband power [dBFS]=w251)
    call "LTE Calculate Power Calibration Offset.gvi"(session in=w248, frequency [Hz]=$"UE RX Frequency [Hz]", error in=w249, LTE scope="DL") -> (session dup=w252, power calibration offset [dB]=w253, error out=w254)
    $"power calibration offset [dB]" <- w253
    Not(x=$"UE AGC") -> w255
    call "LTE Control Power Gain.gvi"(expected signal range lower bound=-17, use manual gain=w255, BB input power=w245, gain in=$"UE Coerced Gain [dB]", manual gain value [dB]=$"UE Manual Gain [dB]", expected signal range upper bound=-15, power calibration offset [dB]=w253) -> (RF input power [dBm]=w256, power [dBFS]=w257, gain out=w258)
    # read sync status and baseband power levels from FPGA and feed them into automatic gain control (AGC)
    # use manual gain value if AGC is disabled
    # configure frequency offset on FPGA
    # read PDSCH decoder status
    Logical And($"UE Receiver", $"UE RX Active", not $"TX starting") -> w259
    # 2
    case (w259) {
      frame False, Default {
        w260 = w254
      }
      frame True {
        call "LTE Apply AGC Output.gvi"(session=w252, LTE scope="DL", error in=w254, apply values=w259, AGC output=w258) -> (coerced gain [dB]=w261, error out=w260)
        $"UE Coerced Gain [dB]" <- w261
      }
    }
    call "Check Stop.gvi"(error in=w260) -> (error out=w262, stop=w263)
    $"UE RF TX Power [dBm]" <- w250
    $"UE Baseband TX Power [dBFS]" <- w251
    $"UE Baseband RX Power [dBFS]" <- w257
    $"UE RF RX Power [dBm]" <- w256
    $"UE Frequency Offset [Hz]" <- w246
    $"Sync Found" <- w247
    $"UE ADC Values Clipped" <- w238
    $"UE TX IFFT Output Clipped" <- w240
    To Unsigned Long Integer(number=i1) -> w264
    Quotient And Remainder(x=w264, y=10) -> (x-y*floor(x/y)=w265)
    Is Equal To 0(x=w265) -> w266
    Logical Or(w241, w266) -> w267
    Feedback Node(enable?=w267, input=w241) -> w268
    Feedback Node(enable?=w266, input=w268) -> w269
    $"UE DDC Values Clipped" <- w269
    next s9 = w262
    stop if w263
  }
  call "Stop On Error.gvi"(error in=s9) -> (error out=w270)
  s10 = w6  # shift register
  while (iteration -> i2) {
    Wait Until Next Multiple(multiple to wait=20)
    Quotient And Remainder(x=i2, y=5) -> (x-y*floor(x/y)=w271)
    Select(s=$"External MAC", t=2, f=w271) -> w272
    # read RX/TX baseband data values and PDCCH/PDSCH constellation data from FPGA and draw corresponding diagrams
    # 3
    case (w272) {
      frame 0, Default {
        call "LTE Read TX Data.gvi"(session=$session, error in=s10) -> (error out=w274, TX baseband data=w275)
        call "LTE Calculate TX Power Spectrum.gvi"(TX data=w275, error in=w274, coerced gain [dB]=$"UE Coerced Max RF TX Power [dBm]") -> (TX power spectrum=w276, error out=w273)
        $"UE TX Power Spectrum" <- w276
      }
      frame 1 {
        call "LTE Read RX Data.gvi"(session=$session, error in=s10) -> (RX data=w277, error out=w278)
        call "LTE Calculate RX Power Spectrum.gvi"(RX data=w277, coerced gain [dB]=$"UE Coerced Gain [dB]", error in=w278, power calibration offset [dB]=$"power calibration offset [dB]") -> (RX power spectrum=w279, error out=w273)
        $"UE RX Power Spectrum" <- w279
      }
      frame 2 {
        call "LTE Read PDCCH Data.gvi"(session in=$session, error in=s10) -> (DCI messages=w280, error out=w281)
        $"PDCCH Received DCI Message" <- w280
        case ($"External MAC") {
          frame False, Default {
            w282 = s10
          }
          frame True {
            call "LTE Read External MAC Output.gvi"(session=$session, error in=s10, full log=FALSE) -> (external MAC log output=w283, error out=w282)
            $"External MAC Output" <- w283
          }
        }
        Merge Errors(w281, w282) -> (error out=w273)
      }
      frame 3 {
        call "LTE Read Constellation Data.gvi"(session=$session, error in=s10, symbol number for display=$"symbol number for PDSCH constellation", RX tab=$Tab) -> (constellation data=w284, display data out=w285, error out=w273, displayed constellation=w286)
        case (w285) {
          frame False, Default { }
          frame True {
            case (w286) {
              frame "DL EQ Output", Default {
                $"PDCCH Constellation" <- w284
              }
              frame "PDSCH Dec Input" {
                $"PDSCH Constellation" <- w284
              }
            }
          }
        }
      }
      frame 4 {
        call "LTE Read Channel Estimates.gvi"(session=$session, error in=s10, UE Context=$"UE RX UE Context") -> (channel estimation=w287, error out=w273, subband SNR [dB]=w288, wideband SNR [dB]=w289)
        $"channel estimation" <- w287
        $"Subband SINR [dB]" <- w288
        $"Wideband SINR [dB]" <- w289
      }
    }
    call "Check Stop.gvi"(error in=w273) -> (error out=w290, stop=w291)
    next s10 = w290
    stop if w291
  }
  sequence {
    frame 0 {
      call "LTE Read External MAC Output.gvi"(session=$session, error in=s10, full log=TRUE) -> (external MAC log output=w292, error out=w293)
      $"External MAC Output" <- w292
    }
  }
  call "Stop On Error.gvi"(error in=w293) -> (error out=w294)
  s11 = 0  # shift register
  s12 = w6  # shift register
  s13 = f64[] []  # shift register
  while {
    Wait Until Next Multiple(multiple to wait=1000)
    # compute throughput and block error rate and draw corresponding diagrams
    Tick Count() -> (timer value=w295)
    Subtract(x=w295, y=s11) -> w296
    call "LTE Calculate DL Throughput and BLER.gvi"(time difference=w296, session=$session, error in=s12, DL throughput previous=s13, throughput select=$"throughput select") -> (DL throughput (current)=w297, DL throughput averaged=w298, DL BLER=w299, BLER cluster=w300, error out=w301, DL throughput current=w302)
    # 4
    case ($"UE RX Active") {
      frame False, Default { }
      frame True {
        $"DL throughput (current)" <- w297
        $"DL throughput" <- w298
        $"UE Failure / Block Error Rate (BLER)" <- w299
      }
    }
    call "Check Stop.gvi"(error in=w301) -> (error out=w303, stop=w304)
    $"BLER cluster" <- w300
    next s11 = w295
    next s12 = w303
    next s13 = w302
    stop if w304
  }
  call "Stop On Error.gvi"(error in=s12) -> (error out=w305)
  s14 = w6  # shift register
  while (iteration -> i3) {
    Quotient And Remainder(x=i3, y=1024) -> (x-y*floor(x/y)=w306)
    To Unsigned Word Integer(number=w306) -> w307
    $"Radio Frame Number" <- w307
    Wait Until Next Multiple(multiple to wait=0)
    # compute feedback information and send it to the FPGA as PUSCH payload data of the transmitter
    call "LTE Compute Feedback Information.gvi"(radioframe number=w307, session=$session, error in=s14) -> (error out=w308, feedback info=w309, session dup=w310)
    call "LTE Send Feedback Information.gvi"(feedback info=w309, session=w310, error in=w308, UL TX active=$"UE TX Active") -> (error out=w311)
    call "Check Stop.gvi"(error in=w311) -> (error out=w312, stop=w313)
    next s14 = w312
    stop if w313
  }
  call "Stop On Error.gvi"(error in=s14) -> (error out=w314)
  Build Array[ConcatenateInputs=True](w235, w270, w294, w305, w314, w9) -> w315
  sequence (after w315) {
    frame 0 {
      # NI API CHANGE
      call "RT Startup Send Notification.gvi"(Error In=s1, Notification="System Stopped!") -> (Error Out=w316)
      call "RT Startup Destroy Notifier.gvi"(error in=w316)
    }
  }
  # NI API CHANGE
  call "LTE Read External MAC Output.gvi"(session=w7, full log=TRUE) -> (external MAC log output=w317)
  $"External MAC Output" <- w317
  sequence {
    frame 0 {
      call "LTE UE Host Cleanup.gvi"(session=$session, error in=no error) -> (error out=w318)
      Build Array[ConcatenateInputs=True](w315, w318) -> w319
      $"FPGA Ready" <- FALSE
    }
  }
  call "LTE Generate Error Report.gvi"(error in=w319) -> (error report=w320, error occured=w321)
  $"Error Report" <- w320
  case (w321) {
    frame False, Default { }
    frame True {
      # Switch to status tab
      # in case of error
      $Tab <- 2
    }
  }
  $"device bandwidth [MHz]" <- w8
