vi "LTE Host eNodeB.gvi"   [LabVIEW Communications System Design Suite 2.0.1]
panel controls:
  "RIO Device": string = "RIO0"  # The RIO address of the RF hardware device
  "eNB TX Frequency [Hz]": f64 = 2000000000  # DL TX center frequency, allowed range depends on used RF device
  "eNB Max RF TX Power [dBm]": f64 = 10  # Maximum RF transmit output power (upper bound - achievable for a full scale complex sine wave (CW) signal) Note: The actual time-domain RF transmit power depends on the configured resource allocation and is typically at least 15dB lower to allow for the OFDM PAPR backoff.
  "UDP Receive Port": u16 = 50000  # The UDP port the host monitors for incoming packets to be transferred to the FPGA PDSCH chain.
  "Reference Clock Source": string = "Internal"  # Configures the Reference Clock source used for the transceiver chain. Internal: Device internal clock REF IN / ClkIn: Clock input at the RF device (i.e. rear connector pane at USRP RIO, front connector pane for NI 579x) PXI_CLK: Backplane clock from the PXI Chassis (NI 579x only) GPS: GPS module (NI USRP RIO 295x only)
  "stop": bool
  "eNB TX RF Port (USRP)": enum{"TX1/RF0", "TX1/RF1"} = "TX1/RF0"  # Selects the HW RF port where the DL TX is transmitted (USRP RIO only).
  "eNB RX Frequency [Hz]": f64 = 1800000000  # UL RX center frequency, allowed range depends on used RF device
  "symbol number for PUSCH constellation": u8 = 4  # The OFDM symbol number used for displaying constellation data for PUSCH IQ samples.
  "eNB RX RF Port (USRP)": enum{"RX2/RF0", "RX2/RF1"} = "RX2/RF1"  # Selects the HW RF port the UL RX will be received from (USRP RIO only)
  "eNB Transmitter": bool  # Enables or disables the transmitter using the current configuration.
  "eNB Receiver": bool  # Enables or disables the receiver using the current configuration.
  "eNB Manual Gain [dB]": f64  # Controls the analog RX gain in case eNB AGC is switched off.
  "eNB AGC": bool = TRUE  # Enables or disables the automated gain control on the receiver side. If enabled the analog RX gain of the RF device will be automatically configured within its valid range to meet a target range for the baseband receive power.
  "Rate Adaption": bool  # If enabled, eNB TX MCS is automatically adapted to reported/measured Wideband SINR [dB] to handle with channel quality fluctuations. The adaptation is calibrated so that the applied MCS produces about 5% to 10% BLER under current MCS conditions. If that is not desired, SINR Offset [dB] needs to be modified.
  "SINR Offset [dB]": f64 = 3  # This value is effectively subtracted from the reported SINR before looking up the MCS in the adaptation table (i.e. if a positive offset is configured, a higher reported SINR is required to adapt to a certain MCS to avoid block errors).
  "eNB TX UE Context": T2 = {"RNTI"=1, "Use UERS"=FALSE, "Antenna Port"=7, "CCE Offset"=0}
    # UE specific parameters for DL transmission.
    # USE UERS: If enabled, the DL transmitter feeds UE-specific reference signals into the PDSCH data stream. The usage of UERS is closely related to Transmission Mode 9 defined in the LTE standard 3GPP TS 36.213 §7.1.
    # RNTI: The radio network temporary identifier used for PDSCH scrambling and PDCCH CRC mask generation.
    # Antenna Port: The antenna port used for generating UERS, Range: 7…14 according to 3GPP TS 36.213 §7.1.
    # CCE Offset: First control channel element to be used for PDCCH transmission. According to 3GPP TS 36.211 §6.8.1/.2.
  "eNB RX UE Context": cluster{"RNTI": u16, "SRS Configuration": T3} = {1, TRUE, "0x200", TRUE}
    # UE-specific parameters for UL reception.
    # RNTI: The radio network temporary identifier used for PUSCH scrambling.
    # SRS Configuration: The configuration used for receiving sounding reference signals.
    # SRS Enabled: If TRUE, SRS location is reserved as last symbol in each UL subframe (FDD, TDD) and last 2 symbols in each special subframe (TDD) (according to 3GPP TS 36.211 §5.5.3.3: FDD: srs-SubframeConfig = 0, TDD: srs-SubframeConfig = 7).
    # SRS Subframe Allocation: Bitmap determining the subframes actually used for SRS transmission. Periodicity of 10, leftmost bit represents subframe 0.
    # Transmission Comb: Parameter transmissionComb k_TC determining if even (0) or odd (1) subcarriers are used for SRS transmission/reception. See also 3GPP TS 36.211 §5.5.3.2.
  "eNB TX Frame Structure": enum{"FDD", "TDD 5 5"} = "FDD"  # Select between frequency division duplex (FDD) and time division duplex (TDD) using subframe configuration 5 and special subframe configuration 5 (3GPP TS 36.211 §4)
  "eNB RX Frame Structure": enum{"FDD", "TDD 5 5"} = "FDD"  # Select between FDD (frequency division duplex) and TDD (time division duplex) using subframe configuration 5 and special subframe configuration 5 (3GPP TS 36.211 §4).
  "eNB RX Cell ID": u16  # The physical Cell ID used for PUSCH scrambling
  "eNB TX Cell ID": u16  # Physical cell ID used for PSS, CRS, UERS sequence generation and PDCCH/PDSCH scrambling. [0…511].
  "eNB TX DCI": T5 = {"Active"=TRUE, "MCS"="MCS 17 (64-QAM, rate ~0.43)", "Resource Block Allocation (4 PRB/bit)"=8388607}  # Downlink control information for the PDCCH content and the PDSCH transmission. MCS: Modulation and coding scheme used for PDSCH transmission according to 3GPP TS 36.213 §7.1.7 Active: Enables or Disables the transmission of PDCCH and PDSCH. Resource Block Allocation: Resource allocation given as bitmap with each bit representing four physical resource blocks (DL resource allocation type 0, 3GPP TS 36.213 §7.1.6.1). The left-most bit represents lowest resource block index.
  "eNB RX DCI": T5 = {"Active"=TRUE, "MCS"="MCS 9 (QPSK, rate ~0.66)", "Resource Block Allocation (4 PRB/bit)"=33554431}  # Parameters for reception of PUSCH. MCS: Modulation and coding scheme used for PUSCH reception according to 3GPP TS 36.213 §7.1.7. Active: Enables or disabled the reception of the PUSCH. Resource Block Allocation: Resource allocation for PUSCH given as bitmap with each bit representing 4 physical resource blocks (DL resource allocation type 0, 3GPP TS 36.312 §7.1.6.1). Leftmost bit represents lowest resource block index.
  "eNB Timing Offset": i32  # Changes the eNodeB timing (start of radio frame). Given in 30.72MS/s.
  "session": "LTE Host Session.gtype"
  "Command": string = "ns3.26-ni-lte-simple-optimized"  # Command to execute for external MAC
  "External MAC": bool = TRUE  # When enabled a program is executed on the RT described by command line and arguments. This switch applies for RT only. When disabled an internal basic MAC will be executed.
  "Arguments": string = "--numPackets=100 --simTime=120 --niApiDevMode=\"NIAPI_BS\" --niApiEnableLogging=\"true\" --niApiLteEnabled=\"true\""  # Arguments to pass to the external MAC.
  "Stop on API Confirmation Errors": bool
  "Start Extern": bool  # When enabled a program is executed on the RT described by command line and arguments. This switch applies for RT only. When disabled an internal basic MAC will be executed.
panel indicators:
  "FPGA Ready": bool  # Signals that the FPGA bitfile has been downloaded and that the device has been initialized and is ready for configuration. (Initialization can take up to 20 seconds.).
  "eNB TX Active": bool  # Signals that all eNB TX control configurations have been applied and the transmitter is running.
  "eNB Coerced Max RF TX Power [dBm]": f64  # Indicates the coerced value actually used as maximum RF transmit output power level after applying the device’s capabilities (range and resolution limitations) to the configured eNB Maximum RF TX Power [dBm].
  "Data Transfer In": bool  # Indicates that the configured UDP stream is receiving data on the configured Receive Port.
  "Packet Loss In": bool  # Indicates that the system loses UDP data due to overload. Data inflow from UDP port is higher than configured PDSCH throughput.
  "eNB TX Power Spectrum": T1  # Shows the power spectrum of the DL TX baseband signal transferred to the RF.
  "eNB Coerced Gain [dB]": f64  # The actual used analog RX RF gain either set by AGC, if enabled, or by UE Manual Gain Value [dB]
  "eNB ADC Values Clipped": bool  # Indicates a numeric overflow at the ADC output. Overflows can be caused when the analog RX RF gain too high or the receive power level too high.
  "eNB Baseband RX Power [dBFS]": f64
  "eNB DDC Values Clipped": bool  # Indicates a numeric overflow at the output of the digital downconversion block Overflows can be caused when the analog RX RF gain too high or the receive power level too high.
  "eNB RX Power Spectrum": T1  # Shows the power spectrum of the UL RX baseband signal received from RF.
  "PUSCH Constellation": c128[]  # Constellation of RX IQ samples allocated for PUSCH transmission after equalization. Only samples for the configured OFDM Symbol-Nr (PUSCH) are displayed.
  "eNB Failure / Block Error Rate (BLER)": f64  # Graphical display of PUSCH reception block error rate.
  "eNB RX Active": bool  # Signals that all eNB RX control configurations have been applied and the receiver is running.
  "PUSCH Throughput [Mbps]": f64  # The achieved throughput on the PUSCH channel.
  "Radio Frame Number": u16  # The number of the latest successfully received report ranging from 0…1023.
  "Reported DL ACK/NACK": enum{"NACK", "ACK", "DTX"}[]  # Array showing the latest received DL ACK/NACK report from UE side.
  "Average DL error rate": f64
  "Reported DL Block Error Rate": f64  # Graphical and numerical representation of the DL receiver block error rate on the UE side reported back to the eNodeB.
  "TX starting": bool
  "eNB TX IFFT Output Clipped": bool  # Indicates a numeric overflow after the IFFT.
  "eNB RF RX Power [dBm]": f64
  "power calibration offset [dB]": f64
  "Reported Subband SINR [dB]": f64[]  # The reported SINR for each subband occupying 8 PRBs. Comparable to Reporting Mode 3-0 in 3GPP TS 36.213 §7.2.1. Usage of CRS or UERS for estimation depends on setting of Use UERS switch in UE RX System Parameters on the UE side
  "Reported WB SINR": f64  # The reported SINR over the full 20MHz band using cell specific reference signals.
  "eNB RF TX Power [dBm]": f64  # Actual eNB RF transmit power in dBm.
  "eNB Baseband TX Power [dBFS]": f64  # Actual eNB baseband transmit power level [baseband output power level] in dB full scale.
  "PUSCH BLER (current)": f64
  "eNB Applied Gain [dB]": f64
  "L1-L2 Interface active": bool
  "PHY Timing Indication Received": u32
  "TTI": u8
  "SFN": u16
  "Max MAC TX Delay": u32
  "Error Report": string
  "UL RX Indication CRC OK": bool
  "Evaluation Errors": u32
  "Negatives": u64
  "Tab": i32
  "device bandwidth [MHz]": u16
  "External MAC Output": string
  "IP Packets Size Exeeded Count": u32
  "Received Confirmations": T11
  "Status": string
types:
  T1 = cluster{"f0": f64, "df": f64, "magnitude": f64[]}
  T2 = cluster{"RNTI": u16, "Use UERS": bool, "Antenna Port": UFXP(4.0), "CCE Offset": u8}
  T3 = cluster{"SRS Enabled": bool, "SRS Subframe Allocation": UFXP(10.0), "Transmission Comb": bool}
  T4 = enum{"MCS 0 (QPSK, rate ~0.12)", "MCS 1 (QPSK, rate ~0.15)", "MCS 2 (QPSK, rate ~0.19)", "MCS 3 (QPSK, rate ~0.25)", "MCS 4 (QPSK, rate ~0.30)", "MCS 5 (QPSK, rate ~0.37)", "MCS 6 (QPSK, rate ~0.44)", "MCS 7 (QPSK, rate ~0.51)", "MCS 8 (QPSK, rate ~0.59)", "MCS 9 (QPSK, rate ~0.66)", "MCS 10 (16-QAM, rate ~0.33)", "MCS 11 (16-QAM, rate ~0.37)", "MCS 12 (16-QAM, rate ~0.42)", "MCS 13 (16-QAM, rate ~0.48)", "MCS 14 (16-QAM, rate ~0.54)", "MCS 15 (16-QAM, rate ~0.60)", "MCS 16 (16-QAM, rate ~0.64)", "MCS 17 (64-QAM, rate ~0.43)", "MCS 18 (64-QAM, rate ~0.46)", "MCS 19 (64-QAM, rate ~0.50)", "MCS 20 (64-QAM, rate ~0.55)", "MCS 21 (64-QAM, rate ~0.60)", "MCS 22 (64-QAM, rate ~0.65)", "MCS 23 (64-QAM, rate ~0.70)", "MCS 24 (64-QAM, rate ~0.75)", "MCS 25 (64-QAM, rate ~0.80)", "MCS 26 (64-QAM, rate ~0.85)", "MCS 27 (64-QAM, rate ~0.89)", "MCS 28 (64-QAM, rate ~0.93)"}
  T5 = cluster{"Active": bool, "MCS": T4, "Resource Block Allocation (4 PRB/bit)": UFXP(25.0)}
  "LTE Transport Session.gtype" = cluster{"FIFO pathname": string, "pipe reader": "Pipe Reader.gtype", "pipe writer": "Pipe Writer.gtype", "transport in RT FIFO": RTFifoRefnum<u8[]>, "transport out RT FIFO": RTFifoRefnum<u8[]>, "transport in timing source name": string, "transport in timing trigger ID": u8, "transport out timing source name": string, "transport out timing trigger ID": u8, "maximum API message size": u32}
  "niInstr Register Bus v0 Host.lvlib__Register Bus Session.gtype" = Queue<"niInstr Register Bus v0 Host.lvlib__Session Data.gtype">
  "Semaphore RefNum.gtype" = i32
  "niUsrpRio Config v1 Host.lvlib__DB Queue Reference.gtype" = Queue<"niUsrpRio Config v1 Host.lvlib__Daughterboard Data.gtype">
  "niUsrpRio Config v1 Host.lvlib__niUsrpRio Session.gtype" = cluster{"FPGA Interface": any, "RIO Interface Number": u32, "Data Clock Rate": u32, "FPGA Data Clock Rate": u32, "Global Settings Register Bus": "niInstr Register Bus v0 Host.lvlib__Register Bus Session.gtype", "Radio 0 Settings Register Bus": "niInstr Register Bus v0 Host.lvlib__Register Bus Session.gtype", "Radio 1 Settings Register Bus": "niInstr Register Bus v0 Host.lvlib__Register Bus Session.gtype", "Radio Settings Bus Semaphore": "Semaphore RefNum.gtype", "DB Queues": "niUsrpRio Config v1 Host.lvlib__DB Queue Reference.gtype"[], "Characterization Data Valid?": bool, "EEPROM Header": "niUsrpRio Config v1 Host.lvlib__EEPROM Header.gtype", "Device Data Header": "niUsrpRio Config v1 Host.lvlib__EEPROM Device Data Header.gtype", "EEPROM Characterization Header": "niUsrpRio Config v1 Host.lvlib__EEPROM Characterization Header.gtype", "Characterization Data": "niUsrpRio Config v1 Host.lvlib__Characterization Data.gtype"[], "FPGA Current Version": u32, "FPGA Oldest Compatible Version": u32, "Fixed Logic Current Version": u32, "Fixed Logic Oldest Compatible Version": u32, "FPGA Radio Settings Bus Current Version": u32, "FPGA Radio Settings Bus Oldest Compatible Version": u32, "FPGA Board Config Current Version": u32, "FPGA Board Config Oldest Compatible Version": u32, "Daughterboard Clock Rate": u32}
  T6 = cluster{"FPGA ref": any, "bus instance": u32, "instruction FIFO depth": u32, "executing on FPGA target": bool, "show error call chain": bool}
  T7 = cluster{"Actual Gain [dB]": f64, "Attenuation Table Index": i32}
  T8 = cluster{"Attenuation Table [dB]": f64[][], "Frequencies [Hz]": f64[], "IQ Imbalance Table": "niUsrpRio Config v1 Host.lvlib__IQ Imbalance.gtype"[], "Gain Table": T7[][]}
  T9 = cluster{"FlexRIO Register Bus": Queue<T6>, "RX Characterization Data": T8, "TX Characterization Data": T8, "FPGA Interface": any}
  T10 = cluster{"transport block size": u32, "CRC ok": bool, "user data": u32}
  "LTE Host Session.gtype" = cluster{"target": enum{"USRP", "FlexRIO"}, "real time mode": bool, "MAC Stub enabled": bool, "DMA FIFO read timeout": i32, "timed loop period": i64, "LTE Transport Sessions": "LTE Transport Session.gtype"[], "USRP session": "niUsrpRio Config v1 Host.lvlib__niUsrpRio Session.gtype", "FlexRIO session": T9, "UDP RX session": UdpNetworkConnectionRefnum, "UDP TX session": UdpNetworkConnectionRefnum, "sync found queue": Queue<bool>, "PDCCH CRC ok queue": Queue<bool>, "DL PDCCH status queue": Queue<cluster{"CRC ok": bool, "subframe number": u32}>, "DL PDSCH status queue": Queue<cluster{"CRC ok": bool, "subframe number": u32}>, "DL SINR queue": Queue<f64[]>, "PDSCH user data queue": Queue<u32>, "PDSCH user data UDP queue": Queue<T10>, "PDSCH user data throughput queue": Queue<T10>, "PUSCH user data queue": Queue<u32>, "PUSCH user data UDP queue": Queue<T10>, "PUSCH user data throughput queue": Queue<T10>, "UE feedback info FIFO": RTFifoRefnum<u8[]>, "Request information FIFO": RTFifoRefnum<"LTE Request Information.gtype">, "UDP TX outbound FIFO": RTFifoRefnum<u8[]>, "UDP RX inbound FIFO": RTFifoRefnum<u8[]>, "stop notifier": Notifier<string>, "DL RX scope": string, "UL RX scope": string, "external MAC log file": string, "external MAC process ID": u32}
  "LTE Confirmation States.gtype" = enum{"Success", "Unknown Message", "Message not Supported", "Unknown Parameter (Set)", "Missing Parameter (Set)", "Parameter (Set) Repetition", "Range Violation", "State Violation", "Timeout", "Config Payload Mismatch", "Length Mismatch", "Input Buffer Full", "Internal Error", "Instance ID Mismatch"}
  T11 = cluster{"Element 1": "LTE Confirmation States.gtype"[], "Value": u64[]}
diagram:
  sequence {
    frame 0 {
      # Set Controls to default values
      $"L1-L2 Interface active" <- FALSE
      $"eNB Transmitter" <- FALSE
      $"eNB Receiver" <- FALSE
      $"FPGA Ready" <- FALSE
      $"eNB RX Active" <- FALSE
      $"eNB TX Active" <- FALSE
      $"TX starting" <- FALSE
      $"eNB TX Power Spectrum" <- T1 {all zero or empty}
      $"eNB RX Power Spectrum" <- T1 {all zero or empty}
      $"eNB Coerced Gain [dB]" <- 0
      $"eNB Coerced Max RF TX Power [dBm]" <- 0
      $"PUSCH Throughput [Mbps]" <- 0
      $"Reported WB SINR" <- 0
      $"Average DL error rate" <- 0
      $"eNB Failure / Block Error Rate (BLER)" <- 0
      $"Reported DL Block Error Rate" <- 0
      $"Reported Subband SINR [dB]" <- f64[] []
      $"PUSCH Constellation" <- c128[] []
      $"Radio Frame Number" <- 0
      $"Reported DL ACK/NACK" <- enum{"NACK", "ACK", "DTX"}[] []
      $"Error Report" <- ""
      $Status <- ""
    }
  }
  call "RT Startup Create Notifier.gvi"(Error In=no error) -> (Error Out=w1)
  # NI API CHANGE
  s1 = w1  # shift register
  while {
    Wait Until Next Multiple(multiple to wait=100)
    call "RT Startup Receive Notivication.gvi"(error in=s1) -> (error out=w2, notification=w3)
    $Status <- w3
    Is Equal(x=w3, y="System Init Complete!") -> w4
    next s1 = w2
    stop if w4
  }
  call "LTE eNodeB Host Initialization.gvi"(USRP device=$"RIO Device", session in=$session, error in=w1, reference clock source=$"Reference Clock Source", start externally=$"Start Extern", external MAC=$"External MAC", command=$Command, arguments=$Arguments) -> (error out=w5, session=w6, device bandwidth=w7)
  sequence {
    frame 0 {
      $session <- w6
      call "Display Error.gvi"(type of dialog="continue or stop message", error in=w5)
      $"L1-L2 Interface active" <- TRUE
    }
  }
  disable {
    frame TARGET_TYPE == "RT", Default {
      # Transport layer moves packets from L1 to MAC Stub implementation or external MAC
      call "LTE Transport.gvi"(session=w6, error in=w5) -> (error out=w9)
      call "LTE Get Transport Session.gvi"(Session=w6, Transport Session Select="Transport PHY Timing to MAC") -> (LTE Transport Session=w10, Session dup=w11)
      Property Node(instance in=w10) -> ("transport out timing source name"=w12)
      w13 = 100  # priority in
      # NI API CHANGE
      timed loop {
        Left Execution System Border Node(priority_in=w13, processor_in=1)
        Left Timing Statistics Border Node() -> (wakeupreason_out=w14)
        call "LTE Get Transport Session.gvi"(Session=w11, Transport Session Select="Transport PHY Timing to MAC") -> (LTE Transport Session=w15, Session dup=w16)
        Left Timing Error Border Node(error_in=w5) -> (error_out=w17)
        call "LTE Transport Read From Transport.gvi"(API transport session=w15, error in=w17, allow read fail=$"L1-L2 Interface active") -> (transport out=w18, transport read success=w19, error out=w20)
        case (w19) {
          frame False {
            w21 = w20
          }
          frame True {
            call "LTE PHY Receive Timing Indication.gvi"(api transport in=w18, error in=w20) -> (SFN=w22, TTI index=w23, error out=w24)
            call "LTE Check Subframe for Transmit.gvi"(frame structure=$"eNB TX Frame Structure", subframe index=w23, UL TX=FALSE, error in=w24) -> (allow DL transmit=w25, error out=w26)
            case (w25) {
              frame False, Default {
                w21 = w26
              }
              frame True {
                w27 = 200  # maximal execution time MPU assembly
                Property Node(instance in=w16) -> ("UDP TX outbound FIFO"=w28, instance out=w29)
                case ($"Rate Adaption") {
                  frame False, Default {
                    w30 = $"eNB TX DCI"
                    w31 = w26
                    w32 = $"eNB TX UE Context"
                    w33 = $"eNB TX Frame Structure"
                    w34 = w22
                    w35 = w23
                  }
                  frame True {
                    call "LTE MCS Regulation.gvi"(SNR offset [dB]=$"SINR Offset [dB]", wideband SNR=$"Reported WB SINR", DCI in=$"eNB TX DCI", UE context=$"eNB TX UE Context") -> (DCI out=w30)
                    $"eNB TX DCI" <- w30
                    w31 = w26
                    w32 = $"eNB TX UE Context"
                    w33 = $"eNB TX Frame Structure"
                    w34 = w22
                    w35 = w23
                  }
                }
                call "LTE MAC Prepare Tx Config.gvi"(SFN=w34, TTI index=w35, eNB TX UE Context=w32, eNB TX DCI=w30, frame structure=w33, error in=w31) -> (MAC TX Config=w36, error out=w37)
                call "LTE MAC PDU Assembly.gvi"(MAC TX config in=w36, error in=w37, data FIFO in=w28, maximal execution time=w27) -> (MAC PDU Size=w38, MAC PDU=w39, error out=w40, IP Packets size exceeded=w41, MAC TX config out=w42)
                Feedback Node(input=w43) -> w44
                Add(w41, w44) -> w43
                $"IP Packets Size Exeeded Count" <- w43
                call "LTE PHY TX Request Confirm Abstraction.gvi"(MAC TX Config=w42, MAC PDU Size=w38, MAC PDU=w39, Device Location="eNB", error in=w40) -> (api transport out=w45, error out=w46, requests=w47)
                Property Node(instance in=w29) -> ("Request information FIFO"=w48, instance out=w49)
                call "LTE MAC Enque Requests.gvi"(RT FIFO reference=w48, requests=w47, error in=w46) -> (error out=w50)
                call "LTE Get Transport Session.gvi"(Session=w49, Transport Session Select="Transport MAC to PHY") -> (LTE Transport Session=w51)
                call "LTE Transport Send To Transport.gvi"(API transport session=w51, transport in=w45, error in=w50) -> (error out=w21)
              }
            }
          }
        }
        Right Timing Error Border Node(error_in=w21) -> (error_out=w52)
        Left Timing Source Border Node[AlarmName=L, DefaultTimingSourceName="1 MHz", DefaultTimingSourceType=2](mode_in="Process missed periods, ignore original phase", period_in=1, source_in=w12, structure_in="MAC Stub Tx")
        continue if $"L1-L2 Interface active"
      }
      call "LTE Remove Timed Loop Abort Error.gvi"(error in=w52, wake up reason=w14) -> (error out=w53)
      call "Stop On Error.gvi"(error in=w53, error source prefix="MAC Stub Tx") -> (error out=w54)
      call "LTE Get Transport Session.gvi"(Session=w6, Transport Session Select="Transport PHY to MAC") -> (LTE Transport Session=w55, Session dup=w56)
      w57 = 98  # priority in
      # NI API CHANGE
      Property Node(instance in=w55) -> ("transport out timing source name"=w58)
      timed loop {
        Left Execution System Border Node(priority_in=w57, processor_in=2)
        Left Timing Statistics Border Node() -> (wakeupreason_out=w59)
        call "LTE Get Transport Session.gvi"(Session=w56, Transport Session Select="Transport PHY to MAC") -> (LTE Transport Session=w60, Session dup=w61)
        Left Timing Error Border Node(error_in=w5) -> (error_out=w62)
        call "LTE Transport Read From Transport.gvi"(API transport session=w60, error in=w62, allow read fail=$"L1-L2 Interface active") -> (transport out=w63, transport read success=w64, error out=w65)
        case (w64) {
          frame False {
            w66 = w65
          }
          frame True {
            call "LTE Decode General Message Header.gvi"(message data in=w63, error in=w65) -> (decoded general message header=w67, error out=w68)
            Property Node(instance in=w67) -> ("message type ID"=w69)
            case (w69) {
              frame 0, Default {
                call "Build Error Cluster.gvi"(code=-1, description="MAC Stub Rx: unexpected API message", error in=w68) -> (error out=w66)
              }
              frame 16898 {
                # PHY_CNF
                Property Node(instance in=w61) -> ("Request information FIFO"=w70)
                Not(x=$"Stop on API Confirmation Errors") -> w71
                call "LTE Handle DL TX Confirm.gvi"(RT FIFO reference=w70, api transport in=w63, error in=w68, clear confirmation errors=w71) -> (error out=w66, confirm received counts=w72, confirmation evaluation error count=w73, negative confirm received count=w74)
                $"Received Confirmations" <- w72
                $Negatives <- w74
                $"Evaluation Errors" <- w73
              }
              frame 17409 {
                call "LTE PHY Receive RX Indication.gvi"(api transport in=w63, expected device location="eNB", error in=w68) -> (MAC RX Config=w75, MAC PDU=w76, error out=w77)
                # PHY_ULSCH_RX_IND
                Property Node(instance in=w75) -> ("CRC Result"=w78)
                Is Greater Than 0(x=w78) -> w79
                case (w79) {
                  frame False, Default {
                    w66 = w77
                  }
                  frame True {
                    call "LTE Extract Payload.gvi"(transport block=w76) -> (payload=w80)
                    Feedback Node(initial value=u8[] [], input=w81) -> w82
                    Build Array[ConcatenateInputs=True](w82, w80) -> w83
                    call "LTE Align Feedback Data.gvi"(data in=w83) -> (remaining portion=w81, feedback payload=w84)
                    Is Empty Array(array=w84) -> w85
                    Not(x=w85) -> w86
                    case (w86) {
                      frame False, Default {
                        w66 = w77
                      }
                      frame True {
                        call "LTE Interpret PUSCH Payload.gvi"(PUSCH payload=w84) -> (radioframe number=w87, ACK/NACK=w88, subband SNR=w89, wideband SNR=w90)
                        $"Radio Frame Number" <- w87
                        $"Reported DL ACK/NACK" <- w88
                        To Double Precision Float(number=w89) -> w91
                        $"Reported Subband SINR [dB]" <- w91
                        To Double Precision Float(number=w90) -> w92
                        $"Reported WB SINR" <- w92
                        call "LTE Calculate Average Error Rate.gvi"(ACK/NACK=w88) -> (error rate=w93)
                        $"Average DL error rate" <- w93
                        Tick Count() -> (timer value=w94)
                        Feedback Node(input=w95) -> w96
                        Is Greater Or Equal(x=w94, y=w96) -> w97
                        case (w97) {
                          frame False, Default {
                            w95 = w96
                          }
                          frame True {
                            $"Reported DL Block Error Rate" <- w93
                            Add(w94, 1000) -> w95
                          }
                        }
                        w66 = w77
                      }
                    }
                  }
                }
                $"UL RX Indication CRC OK" <- w79
              }
            }
          }
        }
        Right Timing Error Border Node(error_in=w66) -> (error_out=w98)
        Left Timing Source Border Node[AlarmName=L, DefaultTimingSourceName="1 MHz", DefaultTimingSourceType=2](mode_in="Process missed periods, ignore original phase", period_in=1, source_in=w58, structure_in="MAC Stub Rx")
        continue if $"L1-L2 Interface active"
      }
      call "LTE Remove Timed Loop Abort Error.gvi"(error in=w98, wake up reason=w59) -> (error out=w99)
      call "Stop On Error.gvi"(error in=w99, error source prefix="MAC Stub Rx") -> (error out=w100)
      Property Node(instance in=w6) -> ("timed loop period"=w101, instance out=w102)
      w103 = 100  # priority in
      # NI API CHANGE
      timed loop {
        # receive PHY TTI timing indication (one per ms)
        Left Execution System Border Node(priority_in=w103, processor_in=1)
        Left Timing Statistics Border Node()
        Left Timing Error Border Node(error_in=w5) -> (error_out=w104)
        call "LTE Receive Timing Indication RT.gvi"(session=w102, error in=w104, eNB TX Active=$"eNB TX Active") -> (error out=w105, subframe index=w106, subframe index valid=w107)
        case (w107) {
          frame False {
            w108 = w105
            w109 = w107
            w110 = w102
          }
          frame True, Default {
            call "Get Time.gvi"(error in_2=w105) -> (tick count (us)=w111, error out_2=w112)
            call "LTE TTI Counter to SFN and TTI.gvi"(TTI counter=w106, error in=w112) -> (SFN=w113, TTI=w114, error out=w115)
            call "Counter U16 Dominant Increment.gvi"() -> (count out=w116)
            call "LTE Encode PHY SAP Timing Indication.gvi"(reference ID=w116, SFN=w113, TTI index=w114, error in=w115) -> (encoded PHY SAP Timing Indication=w117, error out=w118)
            call "LTE Get Transport Session.gvi"(Session=w102, Transport Session Select="Transport PHY Timing to MAC") -> (LTE Transport Session=w119, Session dup=w110)
            call "LTE Transport Send To Transport.gvi"(API transport session=w119, transport in=w117, error in=w118) -> (error out=w108)
            $SFN <- w113
            $TTI <- w114
            $"PHY Timing Indication Received" <- w111
            w109 = w107
          }
        }
        Logical And(w109, $"eNB RX Active") -> w120
        case (w120) {
          frame False, Default {
            w121 = w108
          }
          frame True {
            call "LTE Send Dynamic UL Configuration.gvi"(UE context=$"eNB RX UE Context", DCI=$"eNB RX DCI", scope="RX", session=w110, error in=w108) -> (error out=w121)
          }
        }
        Right Timing Error Border Node(error_in=w121) -> (error_out=w122)
        Left Timing Source Border Node[AlarmName=L, DefaultTimingSourceName="1 MHz", DefaultTimingSourceType=2](mode_in="Discard missed periods, ignore original phase", period_in=w101, structure_in="PHY SAP Tim")
        continue if $"L1-L2 Interface active"
      }
      call "Stop On Error.gvi"(error in=w122, error source prefix="PHY SAP Tim") -> (error out=w123)
      call "LTE Get Transport Session.gvi"(Session=w6, Transport Session Select="Transport MAC to PHY") -> (LTE Transport Session=w124, Session dup=w125)
      # NI API CHANGE
      w126 = 99  # priority in
      Property Node(instance in=w124) -> ("transport out timing source name"=w127)
      timed loop {
        Left Execution System Border Node(priority_in=w126, processor_in=1)
        # handover TX request to PHY FPGA
        Left Timing Statistics Border Node()
        call "LTE Get Transport Session.gvi"(Session=w125, Transport Session Select="Transport MAC to PHY") -> (LTE Transport Session=w128, Session dup=w129)
        Left Timing Error Border Node(error_in=w5) -> (error_out=w130)
        call "LTE Transport Read From Transport.gvi"(API transport session=w128, error in=w130, allow read fail=$"L1-L2 Interface active") -> (transport out=w131, transport read success=w132, error out=w133)
        call "Get Time.gvi"(error in=w133) -> (error out=w134, tick count (us)=w135)
        Subtract(x=w135, y=$"PHY Timing Indication Received") -> w136
        # reserve time buffer to transmit TX data to FPGA
        w137 = 700  # maximal allowed TX processing time [us]
        Is Greater(x=w136, y=w137) -> w138
        case (w132) {
          frame True {
            Property Node(instance in=$"eNB TX UE Context") -> ("Use UERS"=w141)
            call "LTE PHY TX Request Confirm Handler.gvi"(api transport in=w131, Expected SFN=$SFN, Expected TTI index=$TTI, Expected Device Location="eNB", error in=w134, frame structure=$"eNB TX Frame Structure", use UERS=w141, TX request too late=w138) -> (TX UE Context=w142, TX DCI=w143, TX Data=w144, error out=w145, api transport out=w146, output valid=w147)
            Logical And(w147, $"eNB TX Active") -> w140
            case (w140) {
              frame False, Default {
                w148 = w145
                w149 = w129
              }
              frame True {
                call "LTE Send Dynamic DL TX Configuration.gvi"(DCI in=w143, UE context=w142, session=w129, error in=w145) -> (error out=w150, session dup=w151)
                call "LTE Send Dynamic DL Tx Payload.gvi"(session in=w151, TX data=w144, error in=w150) -> (error out=w148, session out=w149)
              }
            }
            Array Size(array=w146) -> (size(s)=w152)
            Is Greater Than 0(x=w152) -> w153
            case (w153) {
              frame False, Default {
                call "Build Error Cluster.gvi"(code=-1, description="Confirmation message response is empty.", error in=w148) -> (error out=w139)
              }
              frame True {
                call "LTE Get Transport Session.gvi"(Session=w149, Transport Session Select="Transport PHY to MAC") -> (LTE Transport Session=w154)
                call "LTE Transport Send To Transport.gvi"(API transport session=w154, transport in=w146, error in=w148) -> (error out=w139)
              }
            }
          }
          frame False {
            w139 = w134
            w140 = w132
          }
        }
        call "Get Time.gvi"(error in=w139) -> (error out=w155, tick count (us)=w156)
        Right Timing Error Border Node(error_in=w155) -> (error_out=w157)
        case (w140) {
          frame True {
            Subtract(x=w156, y=$"PHY Timing Indication Received") -> w158
            call "Get and Hold Maximum.gvi"(value=w158) -> (max value=w159)
            $"Max MAC TX Delay" <- w159
          }
          frame False { }
        }
        Left Timing Source Border Node[AlarmName=L, DefaultTimingSourceName="1 MHz", DefaultTimingSourceType=2](mode_in="Process missed periods, ignore original phase", period_in=1, source_in=w127, structure_in="PHY SAP Tx")
        continue if $"L1-L2 Interface active"
      }
      call "Stop On Error.gvi"(error in=w157, error source prefix="PHY SAP Tx") -> (error out=w160)
      w161 = 98  # priority in
      # NI API CHANGE
      Property Node(instance in=w6) -> ("timed loop period"=w162, instance out=w163)
      timed loop {
        Left Execution System Border Node(priority_in=w161, processor_in=2)
        Left Timing Statistics Border Node()
        Left Timing Error Border Node(error_in=w5) -> (error_out=w164)
        call "LTE Receice PUSCH Decoding Status.gvi"(session=w163, error in=w164) -> (PUSCH Decoding Status valid=w165, PUSCH Decoding Status=w166, error out=w167)
        case (w165) {
          frame False, Default {
            w168 = w167
          }
          frame True {
            Property Node(instance in=w163) -> ("PUSCH user data throughput queue"=w169, instance out=w170)
            call "LTE PDSCH Channel Decoder Status from U32.gvi"(bit vector in=w166, valid in=TRUE) -> (PDSCH decoder status=w171)
            Property Node(instance in=w171) -> ("user data"=w172, "transport block size"=w173, "CRC ok"=w174, instance out=w175)
            Enqueue Element(element=w175, error in=w167, queue=w169, timeout in ms=0) -> (error out=w176)
            call "LTE Receive PUSCH MAC PDU.gvi"(session=w170, transport block size=w173, error in=w176) -> (MAC PDU=w177, error out=w178)
            call "LTE Get Transport Session.gvi"(Session=w170, Transport Session Select="Transport PHY to MAC") -> (LTE Transport Session=w179)
            Boolean To Integer(Boolean=w174) -> (0, 1=w180)
            To Unsigned Byte Integer(number=w180) -> w181
            Array Size(array=w177) -> (size(s)=w182)
            To Unsigned Long Integer(number=w182) -> w183
            To Unsigned Byte Integer(number=w172) -> w184
            call "Counter U16 Dominant Increment.gvi"() -> (count out=w185)
            Property Node(instance in=$"eNB RX UE Context") -> ("RNTI"=w186)
            call "LTE Encode PHY SAP UL RX Indication.gvi"(reference ID=w185, SFN=0, TTI index=w184, MAC PDU=w177, MAC PDU Size=w183, RNTI=w186, CRC Result=w181) -> (encoded UL RX Indication=w187)
            call "LTE Transport Send To Transport.gvi"(API transport session=w179, transport in=w187, error in=w178) -> (error out=w168)
          }
        }
        Right Timing Error Border Node(error_in=w168) -> (error_out=w188)
        Left Timing Source Border Node[AlarmName=L, DefaultTimingSourceName="1 MHz", DefaultTimingSourceType=2](mode_in="Discard missed periods, ignore original phase", period_in=w162, structure_in="PHY SAP Rx")
        continue if $"L1-L2 Interface active"
      }
      call "Stop On Error.gvi"(error in=w188, error source prefix="PHY SAP Rx") -> (error out=w189)
      s2 = w5  # shift register
      while {
        Wait(time to wait=1)
        Property Node(instance in=$session) -> ("UDP TX outbound FIFO"=w190, "UDP TX session"=w191)
        s3 = s2  # shift register
        while {
          Udp Read I Pv 6 Binary(connection ID=w191, error in=s3, max size=10240, timeout ms=0) -> (data out=w194, error out=w195)
          call "Filter Error Codes.gvi"(codes to clear=[1, 113, 66, 56], error in=w195) -> (codes cleared=w196, error cleared?=w197, error out=w198)
          Search 1D Array(1D array=w196, element=113) -> (index of element=w199)
          Is Greater Or Equal To 0(x=w199) -> w200
          Search 1D Array(1D array=w196, element=56) -> (index of element=w201)
          Is Greater Or Equal To 0(x=w201) -> w202
          Not(x=w202) -> w203
          Is Empty Array(array=w194) -> w204
          Not(x=w204) -> w205
          Logical And(w203, w205) -> w206
          case (w197) {
            frame True {
              w207 = w198
            }
            frame False {
              RTFIFO Write(element=w194, error in=w198, overwrite on timeout=TRUE, rt fifo=w190, timeout in ms=0) -> (error out=w207)
            }
          }
          call "Is Error.gvi"(error in=w207) -> (is error?=w208)
          Logical Or(w208, w197, w204) -> w209
          append w200 to w192
          append w206 to w193
          next s3 = w207
          stop if w209
        }
        Or Array Elements(Boolean array=w192) -> (logical OR=w210)
        $"Packet Loss In" <- w210
        Or Array Elements(Boolean array=w193) -> (logical OR=w211)
        $"Data Transfer In" <- w211
        call "Check Stop.gvi"(error in=s3) -> (error out=w212, stop=w213)
        next s2 = w212
        stop if w213
      }
      call "Stop On Error.gvi"(error in=s2) -> (error out=w214)
      Build Array[ConcatenateInputs=True](w54, w100, w9, w123, w160, w189, w214) -> w8
    }
    frame TARGET_TYPE != "RT" {
      s4 = w5  # shift register
      s5 = 0  # shift register
      while {
        Wait Until Next Multiple(multiple to wait=100)
        call "LTE Read UL Data.gvi"(session=$session, error in=s4) -> (error out=w215, radioframe number=w216, output valid=w217, DL ACK/NACK=w218, subband SNR=w219, wideband SNR=w220)
        # read and decode PUSCH feedback information
        # use feedback information to apply correct MCS
        # 5
        case (w217) {
          frame False, Default {
            w221 = s5
            w222 = w215
          }
          frame True {
            $"Radio Frame Number" <- w216
            $"Reported DL ACK/NACK" <- w218
            To Double Precision Float(number=w219) -> w223
            $"Reported Subband SINR [dB]" <- w223
            To Double Precision Float(number=w220) -> w224
            $"Reported WB SINR" <- w224
            call "LTE Calculate Average Error Rate.gvi"(ACK/NACK=w218) -> (error rate=w225)
            $"Average DL error rate" <- w225
            Increment(x=s5) -> w221
            Quotient And Remainder(x=w221, y=10) -> (x-y*floor(x/y)=w226)
            Is Equal To 0(x=w226) -> w227
            case (w227) {
              frame False, Default { }
              frame True {
                $"Reported DL Block Error Rate" <- w225
              }
            }
            w222 = w215
          }
        }
        call "Check Stop.gvi"(error in=w222) -> (error out=w228, stop=w229)
        next s4 = w228
        next s5 = w221
        stop if w229
      }
      call "Stop On Error.gvi"(error in=s4) -> (error out=w230)
      s6 = w5  # shift register
      while {
        # use SINR information to apply correct MCS
        case ($"eNB TX Active") {
          frame False, Default {
            Wait(time to wait=10)
            w231 = s6
            w232 = TRUE
          }
          frame True {
            call "LTE Receive Timing Indication.gvi"(session=$session, error in=s6) -> (session dup=w233, error out=w234, new timing indication=w232)
            case (w232) {
              frame False, Default {
                w231 = w234
              }
              frame True {
                case ($"Rate Adaption") {
                  frame False, Default {
                    w235 = $"eNB TX DCI"
                    w236 = w234
                  }
                  frame True {
                    call "LTE MCS Regulation.gvi"(SNR offset [dB]=$"SINR Offset [dB]", wideband SNR=$"Reported WB SINR", DCI in=$"eNB TX DCI", UE context=$"eNB TX UE Context") -> (DCI out=w235)
                    w236 = w234
                  }
                }
                call "LTE Send Dynamic DL TX Configuration.gvi"(DCI in=w235, UE context=$"eNB TX UE Context", session=w233, error in=w236) -> (error out=w231, coerced DCI=w237, DCI modified=w238)
                case (w238) {
                  frame False, Default { }
                  frame True {
                    $"eNB TX DCI" <- w237
                  }
                }
              }
            }
          }
        }
        Logical And(w232, $"eNB RX Active") -> w239
        # 5
        case (w239) {
          frame False, Default {
            w240 = w231
          }
          frame True {
            call "LTE Send Dynamic UL Configuration.gvi"(UE context=$"eNB RX UE Context", DCI=$"eNB RX DCI", scope="RX", session=$session, error in=w231) -> (error out=w240)
          }
        }
        call "Check Stop.gvi"(error in=w240) -> (error out=w241, stop=w242)
        next s6 = w241
        stop if w242
      }
      call "Stop On Error.gvi"(error in=s6) -> (error out=w243)
      s7 = w5  # shift register
      s8 = 0  # shift register
      while {
        # receive UDP data from network and send it to the FPGA as PDSCH payload data of the transmitter
        # read received PDSCH payload data from FPGA and send it to the specified UDP port
        Wait Until Next Multiple(multiple to wait=0)
        call "LTE Receive UDP Data.gvi"(session=$session, eNB TX active=$"eNB TX Active", UDP packet counter in=s8, error in=s7) -> (FIFO full=w244, data transfer=w245, UDP packet counter out=w246, error out=w247)
        $"Packet Loss In" <- w244
        $"Data Transfer In" <- w245
        # 6
        call "Check Stop.gvi"(error in=w247) -> (error out=w248, stop=w249)
        next s7 = w248
        next s8 = w246
        stop if w249
      }
      call "Stop On Error.gvi"(error in=s7) -> (error out=w250)
      Build Array(w230, w243, w250) -> w8
    }
  }
  s9 = w5  # shift register
  while {
    Wait Until Next Multiple(multiple to wait=100)
    Feedback Node[DelayCount=3](input=w251) -> w252
    call "LTE Determine Configuration Trigger.gvi"(RX enabled=$"eNB Receiver", TX enabled=$"eNB Transmitter") -> (trigger RX configuration=w253, trigger TX configuration=w254)
    # configure eNB RX/TX baseband and RF when enabled
    case (w253) {
      frame False, Default {
        w255 = s9
      }
      frame True {
        case ($"eNB Receiver") {
          frame False, Default {
            call "LTE Disable UL RX.gvi"(session=$session, error in=s9) -> (error out=w255)
            sequence {
              frame 0 {
                $"eNB RX Active" <- FALSE
              }
            }
          }
          frame True {
            Property Node(instance in=$session) -> ("real time mode"=w256)
            call "LTE Setup UL RX Baseband.gvi"(frame structure=$"eNB RX Frame Structure", session in=$session, error in=s9, cell ID=$"eNB RX Cell ID", RF timing offset=$"eNB Timing Offset", UE Context=$"eNB RX UE Context", DCI=$"eNB RX DCI", real time mode=w256) -> (error out=w257, session dup=w258)
            call "LTE Setup RX.gvi"(session in=w258, RX port=$"eNB RX RF Port (USRP)", error in=w257, RX frequency [Hz]=$"eNB RX Frequency [Hz]", gain value [dB]=$"eNB Coerced Gain [dB]", LTE scope="UL") -> (session out=w259, coerced gain [dB]=w260, error out=w261, coerced frequency [Hz]=w262)
            $session <- w259
            $"eNB Coerced Gain [dB]" <- w260
            $"eNB RX Frequency [Hz]" <- w262
            case (w261) {
              frame Error {
                $"eNB Receiver" <- FALSE
                w255 = w261
              }
              frame No Error {
                $"eNB RX Active" <- TRUE
                w255 = w261
              }
            }
          }
        }
      }
    }
    # 1
    case (w254) {
      frame False, Default {
        w263 = s9
      }
      frame True {
        case ($"eNB Transmitter") {
          frame False, Default {
            sequence {
              frame 0 {
                $"eNB TX Active" <- FALSE
              }
              frame 1 {
                Wait(time to wait=10)
              }
            }
            call "LTE Disable DL TX.gvi"(session=$session, error in=s9) -> (error out=w263)
          }
          frame True {
            case (s9) {
              frame Error {
                w264 = s9
              }
              frame No Error {
                $"TX starting" <- TRUE
                w264 = s9
              }
            }
            Property Node(instance in=$session) -> ("real time mode"=w265)
            call "LTE Setup DL TX Baseband.gvi"(session in=$session, UDP receive port=$"UDP Receive Port", frame structure=$"eNB TX Frame Structure", cell ID=$"eNB TX Cell ID", UE context=$"eNB TX UE Context", error in=w264, DCI=$"eNB TX DCI", real time mode=w265) -> (session out=w266, error out=w267)
            call "LTE Setup TX.gvi"(session in=w266, TX frequency [Hz]=$"eNB TX Frequency [Hz]", TX power level [dB]=$"eNB Max RF TX Power [dBm]", TX port=$"eNB TX RF Port (USRP)", error in=w267, LTE scope="DL", timing advance=0) -> (coerced output power [dB]=w268, error out=w269, session dup=w270, coerced frequency [Hz]=w271, coerced power level setting [dB]=w272)
            $session <- w270
            $"eNB Coerced Max RF TX Power [dBm]" <- w268
            case (w269) {
              frame No Error, Default {
                $"eNB TX Active" <- TRUE
                $"TX starting" <- FALSE
                call "LTE Setup DL TX Set Active.gvi"(session in=w270, error in=w269) -> (error out=w263)
              }
              frame Error {
                $"eNB Transmitter" <- FALSE
                $"TX starting" <- FALSE
                call "LTE Check UDP Port In Use.gvi"(error in=w269) -> (error out=w263)
              }
            }
            $"eNB TX Frequency [Hz]" <- w271
            $"eNB Max RF TX Power [dBm]" <- w272
          }
        }
      }
    }
    Merge Errors(w255, w263) -> (error out=w273)
    # synchronize the exit condition across all loops of the host application
    call "Create Stop.gvi"(error in=w273, stop in=$stop) -> (error out=w274)
    call "Check Stop.gvi"(error in=w274) -> (error out=w275, stop=w251)
    # Disable TX and RX to
    # ensure proper shutdown
    Not(x=w251) -> w276
    $"L1-L2 Interface active" <- w276
    case (w251) {
      frame False, Default { }
      frame True {
        $"eNB Receiver" <- FALSE
        $"eNB Transmitter" <- FALSE
      }
    }
    case (s9) {
      frame Error { }
      frame No Error {
        $"FPGA Ready" <- TRUE
      }
    }
    next s9 = w275
    stop if w252
  }
  call "Stop On Error.gvi"(error in=s9) -> (error out=w277)
  s10 = w5  # shift register
  while (iteration -> i1) {
    Wait Until Next Multiple(multiple to wait=50)
    disable {
      frame TARGET_TYPE == "RT", Default {
        w278 = $session
        w279 = s10
      }
      frame TARGET_TYPE != "RT" {
        call "LTE Read PUSCH Decoder Status.gvi"(session in=$session, error in=s10) -> (error out=w279, session dup=w278)
      }
    }
    call "LTE Get ADC and IFFT Status.gvi"(session in=w278, error in=w279) -> (ADC values clipped=w280, error out=w281, TX IFFT output clipped=w282, RX DDC values clipped=w283, session dup=w284)
    call "LTE Read UL BB Power.gvi"(error in=w281, session in=w284) -> (session dup=w285, error out=w286, RX baseband input power=w287)
    call "LTE Read TX BB Power.gvi"(error in=w286, session in=w285, TX reference level [dBm]=$"eNB Coerced Max RF TX Power [dBm]", LTE scope="DL") -> (session dup=w288, error out=w289, TX power [dBm]=w290, TX baseband power [dBFS]=w291)
    call "LTE Calculate Power Calibration Offset.gvi"(session in=w288, frequency [Hz]=$"eNB RX Frequency [Hz]", error in=w289, LTE scope="UL") -> (session dup=w292, power calibration offset [dB]=w293, error out=w294)
    $"power calibration offset [dB]" <- w293
    Not(x=$"eNB AGC") -> w295
    call "LTE Control Power Gain.gvi"(expected signal range lower bound=-17, use manual gain=w295, BB input power=w287, gain in=$"eNB Coerced Gain [dB]", manual gain value [dB]=$"eNB Manual Gain [dB]", expected signal range upper bound=-15, power calibration offset [dB]=w293) -> (RF input power [dBm]=w296, power [dBFS]=w297, gain out=w298)
    # read sync status and baseband power levels from FPGA and feed them into automatic gain control (AGC)
    # use manual gain value if AGC is disabled
    # configure frequency offset on FPGA
    # read PUSCH decoder status
    Logical And(not $"TX starting", $"eNB Receiver", $"eNB RX Active") -> w299
    # 2
    case (w299) {
      frame False, Default {
        w300 = w294
      }
      frame True {
        call "LTE Apply AGC Output.gvi"(session=w292, LTE scope="UL", error in=w294, apply values=w299, AGC output=w298) -> (coerced gain [dB]=w301, error out=w300)
        $"eNB Coerced Gain [dB]" <- w301
      }
    }
    call "Check Stop.gvi"(error in=w300) -> (error out=w302, stop=w303)
    $"eNB RF TX Power [dBm]" <- w290
    $"eNB Baseband TX Power [dBFS]" <- w291
    $"eNB Baseband RX Power [dBFS]" <- w297
    $"eNB RF RX Power [dBm]" <- w296
    $"eNB Applied Gain [dB]" <- $"eNB Coerced Gain [dB]"
    $"eNB ADC Values Clipped" <- w280
    $"eNB TX IFFT Output Clipped" <- w282
    To Unsigned Long Integer(number=i1) -> w304
    Quotient And Remainder(x=w304, y=10) -> (x-y*floor(x/y)=w305)
    Is Equal To 0(x=w305) -> w306
    Logical Or(w283, w306) -> w307
    Feedback Node(enable?=w307, input=w283) -> w308
    Feedback Node(enable?=w306, input=w308) -> w309
    $"eNB DDC Values Clipped" <- w309
    next s10 = w302
    stop if w303
  }
  call "Stop On Error.gvi"(error in=s10) -> (error out=w310)
  s11 = w5  # shift register
  while (iteration -> i2) {
    Wait Until Next Multiple(multiple to wait=20)
    # NI API CHANGE
    Quotient And Remainder(x=i2, y=5) -> (x-y*floor(x/y)=w311)
    Select(s=$"External MAC", t=3, f=w311) -> w312
    # read RX/TX baseband data values and PDCCH/PDSCH constellation data from FPGA and draw corresponding diagrams
    # 3
    case (w312) {
      frame 0, Default {
        call "LTE Read TX Data.gvi"(session=$session, error in=s11) -> (error out=w314, TX baseband data=w315)
        call "LTE Calculate TX Power Spectrum.gvi"(TX data=w315, error in=w314, coerced gain [dB]=$"eNB Coerced Max RF TX Power [dBm]") -> (TX power spectrum=w316, error out=w313)
        $"eNB TX Power Spectrum" <- w316
      }
      frame 1 {
        call "LTE Read RX Data.gvi"(session=$session, error in=s11) -> (RX data=w317, error out=w318)
        call "LTE Calculate RX Power Spectrum.gvi"(RX data=w317, coerced gain [dB]=$"eNB Coerced Gain [dB]", error in=w318, power calibration offset [dB]=$"power calibration offset [dB]") -> (RX power spectrum=w319, error out=w313)
        $"eNB RX Power Spectrum" <- w319
      }
      frame 2 {
        call "LTE Read Constellation Data.gvi"(session=$session, error in=s11, symbol number for display=$"symbol number for PUSCH constellation", RX tab=-1) -> (constellation data=w320, display data out=w321, error out=w313)
        case (w321) {
          frame False, Default { }
          frame True {
            $"PUSCH Constellation" <- w320
          }
        }
      }
      frame 3 {
        case ($"External MAC") {
          frame False, Default {
            w313 = s11
          }
          frame True {
            call "LTE Read External MAC Output.gvi"(session=$session, error in=s11, full log=FALSE) -> (external MAC log output=w322, error out=w313)
            $"External MAC Output" <- w322
          }
        }
      }
      frame 4 {
        w313 = s11
      }
    }
    call "Check Stop.gvi"(error in=w313) -> (error out=w323, stop=w324)
    next s11 = w323
    stop if w324
  }
  sequence {
    frame 0 {
      # NI API CHANGE
      call "LTE Read External MAC Output.gvi"(session=$session, error in=s11, full log=TRUE) -> (external MAC log output=w325, error out=w326)
      $"External MAC Output" <- w325
    }
  }
  call "Stop On Error.gvi"(error in=w326) -> (error out=w327)
  s12 = 0  # shift register
  s13 = w5  # shift register
  while {
    Wait Until Next Multiple(multiple to wait=1000)
    # compute throughput and block error rate and draw corresponding diagrams
    Tick Count() -> (timer value=w328)
    Subtract(x=w328, y=s12) -> w329
    call "LTE Calculate UL Throughput and BLER.gvi"(time difference=w329, session=$session, error in=s13) -> (UL throughput (current)=w330, error out=w331, UL BLER=w332)
    # 4
    case ($"eNB RX Active") {
      frame False, Default { }
      frame True {
        $"PUSCH Throughput [Mbps]" <- w330
        $"eNB Failure / Block Error Rate (BLER)" <- w332
        $"PUSCH BLER (current)" <- w332
      }
    }
    call "Check Stop.gvi"(error in=w331) -> (error out=w333, stop=w334)
    next s12 = w328
    next s13 = w333
    stop if w334
  }
  call "Stop On Error.gvi"(error in=s13) -> (error out=w335)
  Build Array[ConcatenateInputs=True](w277, w310, w327, w335, w8) -> w336
  sequence (after w336) {
    frame 0 {
      # NI API CHANGE
      call "RT Startup Send Notification.gvi"(Error In=s1, Notification="System Stopped!") -> (Error Out=w337)
      call "RT Startup Destroy Notifier.gvi"(error in=w337)
    }
  }
  # NI API CHANGE
  call "LTE Read External MAC Output.gvi"(session=w6, full log=TRUE) -> (external MAC log output=w338)
  $"External MAC Output" <- w338
  sequence {
    frame 0 {
      call "LTE eNodeB Host Cleanup.gvi"(session=$session, error in=no error) -> (error out=w339)
      Build Array[ConcatenateInputs=True](w336, w339) -> w340
      $"FPGA Ready" <- FALSE
    }
  }
  call "LTE Generate Error Report.gvi"(error in=w340) -> (error report=w341, error occured=w342)
  $"Error Report" <- w341
  case (w342) {
    frame False, Default { }
    frame True {
      # Switch to status tab
      # in case of error
      $Tab <- 2
    }
  }
  $"device bandwidth [MHz]" <- w7
